# Grasshopper definition sneaker_Robot Pathing.gh (Grasshopper 1.0.7)
# plug-ins: VirtualRobot.Grasshopper

# ---- group: Syntax
front_reinforce_right_gradient_shift = Geometry(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)
front_reinforce_left_gradient_shift = Geometry(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)
back_reinforce_right_gradient = Geometry(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)
back_reinforce_left_gradient = Geometry(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)
middle_right_gradient_shift = Geometry(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)
front_base_right_side_shift = Geometry(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)
middle_right_x_approach = Geometry(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)
middle_left_gradient_shift = Geometry(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)
front_base_left_side_shift = Geometry(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)
middle_left_x_approach = Geometry(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)
back_base_right_weave = Geometry(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)
back_base_left_weave = Geometry(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)

# ---- group: Anchors
points_on_top_frame = Point([Point(107.9469306, 0, 105.8224003), Point(107.6803451, -1.446105394, 105.8179056), Point(106.9761415, -2.740536694, 105.7952575), Point(105.9987291, -3.84518491, 105.7374702), Point(104.8624854, -4.78354202, 105.6345315), Point(103.6325333, -5.587621387, 105.4791101)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])
points_on_bottom_frame = Point([Point(123.0264757, 2.420803567, 44.1654435), Point(122.9085908, -1.079489238, 44.18770846), Point(122.0639216, -4.474939387, 44.11892086), Point(120.3598206, -7.525035271, 44.00225049), Point(117.8968807, -10.00879508, 43.89399937), Point(115.0199266, -12.00962324, 43.80461133)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])

# ----
orient = Orient(Source=PlaneXY(0, 0, 0), Target=PlaneXY(0, 0, 0))  # -> Geometry, Transform

# ----
# Step 1: Fiber Syntax
entwine = Entwine(Branch00=points_on_top_frame, Branch01=points_on_bottom_frame, FlattenInputs=True)
c_getsyntaxlist = CSharpScript(anchorPts=simplify(entwine), syntax=middle_left_gradient_shift)  # -> out, syntaxList; inputs anchorPts: tree of Point3d, syntax: Polyline
# ---------- c_getsyntaxlist: C# ----------
    //assign unique ID to each anchor point
    anchors = new List<Anchor>();

    for(int i = 0; i < anchorPts.BranchCount; i++)
    {
      for(int j = 0; j < anchorPts.Branch(i).Count; j++)
      {
        Anchor anchor = new Anchor();
        anchor.Position = anchorPts.Branch(i)[j];
        anchor.ID = j + Number2Alphabet(i, true);

        anchors.Add(anchor);
      }
    }

    // check whether polyline pts are identical with the anchors, if so output anchor ID in list
    List<string> syntaxAnchorIDs = GetAnchorIDs(syntax);

    syntaxList = syntaxAnchorIDs;
# ---------- c_getsyntaxlist: C# additional code ----------
  List<Anchor> anchors = new List<Anchor>();

  public class Anchor
  {
    public Point3d Position;
    public string ID;
  }

  public List<string> GetAnchorIDs(Polyline syntax)
  {
    List<string> syntaxAnchorIDs = new List<string>();

    for(int i = 0; i < syntax.Count; i++)
    {
      for (int j = 0; j < anchors.Count; j++)
      {
        if (anchors[j].Position == syntax[i])
        {
          syntaxAnchorIDs.Add(anchors[j].ID);
        }
      }
    }

    return syntaxAnchorIDs;
  }

  public static string Number2Alphabet(int number, bool isCaps)
  {
    Char c = (Char) ((isCaps ? 65 : 97) + number);

    return c.ToString();
  }
# ---------- end c_getsyntaxlist ----------

# ----
# Step 2: Tool Path Planning
number_slider = Slider(117, range=0..1000)
list_length = ListLength(List=c_getsyntaxlist.syntaxList)
xy_plane = XYPlane(Origin=Point(0, 0, 0))
duplicate_data = DuplicateData(Data="U", Number=list_length, Order=True)
c_travel = CSharpScript(anchorPts=simplify(entwine), syntax=c_getsyntaxlist.syntaxList, travelOffset=number_slider, orientation=xy_plane)  # -> out, travelPlns, syntaxPts, anchorPlns; inputs anchorPts: tree of Point3d, syntax: list of String, travelOffset: Double, orientation: Plane
# ---------- c_travel: C# usings ----------
using System.Linq;
# ---------- c_travel: C# ----------
    // create Planes & Polyline
    List<Point3d> polyPoints = new List<Point3d>();
    List<Plane> anchorPlanes = new List<Plane>();

    for (int i = 0; i < syntax.Count - 1; i++)
    {
      // get both endpoints of segment
      string segStart = syntax[i];
      string segEnd = syntax[i + 1];

      //split string & cast to number
      var digitsStart = segStart.Where(c => Char.IsDigit(c));
      var digitsEnd = segEnd.Where(c => Char.IsDigit(c));

      // Execute the second query
      string digitStart = "";
      foreach (char c in digitsStart)
        digitStart += c;
      int indStart = int.Parse(digitStart);

      string digitEnd = "";
      foreach (char c in digitsEnd)
        digitEnd += c;
      int indEnd = int.Parse(digitEnd);

      //get points
      Point3d startPl = new Point3d();
      Point3d endPl = new Point3d();

      for(int j = 0; j < anchorPts.BranchCount; j++)
      {
        if(segStart.Contains(Number2Alphabet(j, true)))
        {
          startPl = anchorPts.Branch(j)[indStart];
        }
        if(segEnd.Contains(Number2Alphabet(j, true)))
        {
          endPl = anchorPts.Branch(j)[indEnd];
        }
      }

      polyPoints.Add(startPl);
      if (i == syntax.Count - 2)
        polyPoints.Add(endPl);
    }

    Surface s = null;

    if(anchorPts.BranchCount == 2)
    {
      // create expected surface
      List<Curve> edgeCurves = new List<Curve>();


      Curve a = Curve.CreateInterpolatedCurve(anchorPts.Branch(0), 3);
      edgeCurves.Add(a);
      Curve b = Curve.CreateInterpolatedCurve(anchorPts.Branch(1), 3);
      edgeCurves.Add(b);

      Brep brep = Brep.CreateFromLoft(edgeCurves, Point3d.Unset, Point3d.Unset, LoftType.Tight, false)[0];
      s = brep.Faces[0];
    }

    DataTree<Plane> windingPlanes = new DataTree<Plane>();


    for (int i = 0; i < syntax.Count - 1; i++)
    {
      Vector3d vec = polyPoints[i] - polyPoints[i + 1];
      LineCurve ln = new LineCurve(polyPoints[i], polyPoints[i + 1]);

      if(anchorPts.BranchCount == 2)
      {
        double u;
        double v;
        double u1;
        double v1;

        s.ClosestPoint(polyPoints[i], out u, out v);
        s.ClosestPoint(polyPoints[i + 1], out u1, out v1);
        Plane anchorPln = new Plane(polyPoints[i], s.NormalAt(u, v));

        anchorPlanes.Add(anchorPln);

        double[] crvParams = ln.DivideByCount(4, false);
        windingPlanes.Add(new Plane(ln.PointAt(crvParams[0]) + s.NormalAt(u, v) * -travelOffset, Plane.WorldXY.ZAxis, Vector3d.CrossProduct(Plane.WorldXY.ZAxis, s.NormalAt(u, v))), new GH_Path(i));
        windingPlanes.Add(new Plane(ln.PointAt(crvParams[2]) + s.NormalAt(u1, v1) * -travelOffset, Plane.WorldXY.ZAxis, Vector3d.CrossProduct(Plane.WorldXY.ZAxis, s.NormalAt(u1, v1))), new GH_Path(i));
      }
      else
      {
        Plane anchorPln = new Plane(polyPoints[i], Plane.WorldXY.ZAxis);

        anchorPlanes.Add(anchorPln);

        double[] crvParams = ln.DivideByCount(4, false);
        windingPlanes.Add(new Plane(ln.PointAt(crvParams[0]) + new Vector3d(0.0, 0.0, travelOffset), orientation.Normal), new GH_Path(i));
        windingPlanes.Add(new Plane(ln.PointAt(crvParams[2]) + new Vector3d(0.0, 0.0, travelOffset), orientation.Normal), new GH_Path(i));
      }
    }

    if(anchorPts.BranchCount == 2)
    {
      double u2;
      double v2;
      s.ClosestPoint(polyPoints[syntax.Count - 1], out u2, out v2);

      anchorPlanes.Add(new Plane(polyPoints[syntax.Count - 1], s.NormalAt(u2, v2)));
    }
    else
    {
      anchorPlanes.Add(new Plane(polyPoints[syntax.Count - 1], Plane.WorldXY.ZAxis));
    }

    //outputs
    travelPlns = windingPlanes;
    syntaxPts = polyPoints;
    anchorPlns = anchorPlanes;
# ---------- c_travel: C# additional code ----------
  public static string Number2Alphabet(int number, bool isCaps)
  {
    Char c = (Char) ((isCaps ? 65 : 97) + number);

    return c.ToString();
  }
# ---------- end c_travel ----------
travel_plane = Plane(c_travel.travelPlns)
anchor_plane = Plane(c_travel.anchorPlns)
c_hooking = CSharpScript(
    syntaxPts=c_travel.syntaxPts,
    hookingTypes=duplicate_data,
    anchorPlns=anchor_plane,
    hookingRadius=Slider(3, range=0..100),
    travelPlns=travel_plane)  # -> out, hookingPlns; inputs syntaxPts: list of Point3d, hookingTypes: list of String, anchorPlns: list of Plane, hookingRadius: Double, travelPlns: tree of Plane
# ---------- c_hooking: C# ----------
    DataTree<Plane> hookingPlanes = new DataTree<Plane>();

    Print(hookingTypes.Count.ToString());

    for (int i = 0; i < syntaxPts.Count; i++)
    {
      hookingPlanes.AddRange(HookingMotion(syntaxPts[i], hookingTypes[i], anchorPlns[i], travelPlns, hookingRadius, i), new GH_Path(i));
    }

    hookingPlns = hookingPlanes;
# ---------- c_hooking: C# additional code ----------
  public List<Plane> HookingMotion(Point3d origin, string hookingType, Plane anchorPln, DataTree<Plane> travelSegments, double hookingRadius, int id)
  {
    List<Plane> hookingPlanes = new List<Plane>();

    Point3d startPt = Point3d.Unset;
    Point3d endPt = Point3d.Unset;
    Point3d startPtremapped;

    Plane xy = anchorPln;
    Vector3d start = new Vector3d();
    Vector3d end = new Vector3d();
    double angle = 0;;

    if (id == 0)
    {
      endPt = travelSegments.Branch(id)[0].Origin;
      end = xy.Origin - endPt;
      start = new Vector3d(end);
      start.Reverse();
      angle = 2 * Math.PI;
    }

    else if (id > travelSegments.BranchCount - 1)
    {
      startPt = travelSegments.Branch(id - 1)[1].Origin;
      start = xy.Origin - startPt;
      end = new Vector3d(start);
      end.Reverse();
      angle = 2 * Math.PI;
    }

    if (id > 0 && id < travelSegments.BranchCount) {

      startPt = travelSegments.Branch(id - 1)[1].Origin;
      endPt = travelSegments.Branch(id)[0].Origin;

      start = xy.Origin - startPt;
      end = xy.Origin - endPt;
      angle = 2 * Math.PI - Vector3d.VectorAngle(start, end);
    }

    double _s;
    double _t;
    xy.ClosestParameter(startPt, out _s, out _t);
    startPtremapped = xy.PointAt(_s, _t);
    Vector3d xDir = startPtremapped - origin;
    //Vector3d zDir = centerProjected - origin;
    //Vector3d zDir = Plane.WorldXY.ZAxis;
    Vector3d zDir = anchorPln.Normal;
    Vector3d yDir = Vector3d.CrossProduct(xDir, zDir);

    xy = new Plane(origin, xDir, yDir);

    //map endpoint - check y value, needs to be negative
    double sEnd;
    double tEnd;
    xy.ClosestParameter(endPt, out sEnd, out tEnd);

    if (tEnd > 0)
    {
      yDir = -1 * Vector3d.CrossProduct(xDir, zDir);
      xy = new Plane(origin, xDir, yDir);
    }

    int steps = 4;

    double increment = angle / steps;

    for (int i = 0; i < steps; i++)
    {
      // need to set correct starting point! rotate plane!

      double t = increment * i;

      double a = Math.Cos(t) * (hookingRadius);
      double b = Math.Sin(t) * (hookingRadius);

      Point3d pt = new Point3d(a * xy.XAxis + b * xy.YAxis) + origin;

      Point3d centerPj = new Point3d(Plane.WorldXY.Origin.X, Plane.WorldXY.Origin.Y, pt.Z);

      // fix hardcoded vector
      Vector3d x = new Vector3d(0, -1, 0);
      Vector3d z = anchorPln.Normal;
      Vector3d offsetVec = new Vector3d(z);
      offsetVec.Unitize();
      offsetVec *= hookingRadius;
      Vector3d y = Vector3d.CrossProduct(x, z);

      Plane hookingPln = Plane.Unset;
      
      /*if(i == 1 || i == 2)
      {
        hookingPln = new Plane(pt, x, y);
      }
      else
      {
        hookingPln = new Plane(pt + z * 15 , x, y);
      }*/
      
      if(id == 0 && i == 0)
      {
        Plane approachPln = new Plane(pt + z * 120, x, y);
        approachPln.Flip();
        hookingPlanes.Add(approachPln);
      }

      hookingPln = new Plane(pt, x, y);
      hookingPln.Flip();

      hookingPlanes.Add(hookingPln);

      if(id == travelSegments.BranchCount && i == steps - 1)
      {
        Plane approachPln = new Plane(pt + z * 120, x, y);
        approachPln.Flip();
        hookingPlanes.Add(approachPln);
      }
    }

    if(hookingType == "X") hookingPlanes.Reverse();

    return hookingPlanes;
  }
# ---------- end c_hooking ----------
panel = Panel("{1,2,5,6...}")
plane = Plane(c_hooking.hookingPlns)
panel_2 = Panel(plane)
split_tree = SplitTree(Data=plane, Masks=flatten("{0,2,...}"))  # -> Positive, Negative
panel_3 = Panel(split_tree.Positive)
plane_2 = Plane(split_tree.Negative)
panel_4 = Panel(plane_2)
rotate_plane = RotatePlane(Plane=travel_plane, Angle=degrees(Slider(123, range=0..180)))
rotate_plane_2 = RotatePlane(Plane=split_tree.Positive, Angle=degrees(Slider(32, range=0..180)))
rotate_plane_3 = RotatePlane(Plane=split_tree.Negative, Angle=degrees(Slider(44, range=0..180)))
merge = Merge(Data1=rotate_plane_2, Data2=rotate_plane_3)
c_fiber_path = CSharpScript(travelPlns=rotate_plane, hookingPlns=merge)  # -> out, windingPlns, pathCurve; inputs travelPlns: tree of Plane, hookingPlns: tree of Plane
# ---------- c_fiber_path: C# ----------
    List<Plane> plns = new List<Plane>();

    for (int i = 0; i <= travelPlns.BranchCount; i++)
    {
      if(i < travelPlns.BranchCount)
      {
        plns.AddRange(hookingPlns.Branch(i));
        if(travelPlns.Branch(i)[0].Origin.DistanceTo(travelPlns.Branch(i)[1].Origin) > 150)
        {
          plns.AddRange(travelPlns.Branch(i));
        }
      }
      else if(i == travelPlns.BranchCount)
      {
        plns.AddRange(hookingPlns.Branch(i));
      }
    }

    // construct polyline
    List<Point3d> polyPoints = new List<Point3d>();

    foreach (Plane p in plns)
    {
      polyPoints.Add(p.Origin);
    }

    Polyline pl = new Polyline(polyPoints);

    windingPlns = plns;
    pathCurve = pl;
# ---------- end c_fiber_path ----------

pt = Point(Point(-15487.94509, -3949.973942, -2.96))
pt_2 = Point(Point(-15110.80273, -3940.73584, 739.5223999))

# ----
# Step 3: END EFFECTOR
tool_abc = Panel("0,-90,0")
vec2pt = Vector2Pt(PointA=pt, PointB=pt_2, Unitize=False)  # -> Vector, Length
test_tool = TESTTOOL()  # -> pl_2, G
tool_xyz = Panel(vec2pt.Vector)
sframe = SetFrame(XYZLocation=vec2pt.Vector, ABCOrientation=tool_abc)
flange = XYPlane(Origin=pt)
tcp = PlaneOrigin(Base=sframe, Origin=pt_2)
xy = XYPlane(Origin=Point(0, 0, 0))
mesh = Mesh(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)
pflip = FlipPlane(Plane=test_tool.pl_2, ReverseX=False, ReverseY=False, SwapAxes=True)
coord_display = CoordinateFrameDisplay(
    CoordinateFrame=tcp,
    ArrowLengths=[120, 120, 120],
    ArrowWidths=[1, 1, 1],
    ArrowColors=[RGB(139, 0, 0), RGB(0, 100, 0), RGB(0, 0, 139)])
end_effector = DefineEndEffector(Geometry=mesh, TCPFrame=tcp, MountingFrame=flange)
sframe_2 = SetFrame(XYZLocation=tool_xyz, ABCOrientation=tool_abc)

# ----
# Step 4: ROBOT SIMULATION
# if you switch the syntax to “diagonal”, as you
# simulate the robot (slider here), you will notice some
# of the planes are not reachble (robot kinematic
# component become orange) for the robot with
# the rotations that we set up for the other syntax;
# so what we can do is when we split our tree of hooking planes,
# we need to specify different rotation
# vaues for the edge close to the robot;
# 
# so you need to find a suitable rotation that
# works for the specific syntax and factor
robot_path = Slider(0.09, range=0..0.999)
xy_2 = XYPlane(Origin=Point(0, 0, 0))
interpolate_frames = InterpolateFrames(Frames=c_fiber_path.windingPlns, Length=robot_path, Step="20", Reset=Toggle(True))  # -> Frame, Percent, CurrentIndex
kuka_kr_125_2 = PredefinedKUKAKR1252(RobRootFrame=PlaneXY(0, 0, 0), EndEffectorOptional=end_effector)

# ----
# this robot kinematic component outputs the robot
# pose as a mesh, and you can bake the output
robot_ik = RobotInverseKinematics(Robot=kuka_kr_125_2, TargetTCPFrame=interpolate_frames.Frame, AxisToggles=[False, False, False], useColorPreview=True)  # -> PoseGeometry, AxisValues, AxisFrames
mesh_2 = Mesh(robot_ik.PoseGeometry)

# ==== cluster TESTTOOL
number_slider = Slider(94.9, range=0..100)
orientation_marker = Mesh(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)

# ---- group: EFFECTOR GEOMETRY
mesh = Mesh(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)

# ----
xy = XYPlane(Origin=Point(0, 0, 0))
mjoin = MeshJoin(Meshes=[mesh, orientation_marker])
Z = UnitZ(Factor=number_slider)
move = Move(Geometry=mjoin, Motion=Z)  # -> Geometry, Transform
rad = Radians(Degrees=Slider(90, range=0..100))
scale_nu = ScaleNU(Geometry=mjoin, Plane=xy, ScaleX=Slider(1.001, range=0..10), ScaleY=1, ScaleZ=Slider(1.183, range=0..10))  # -> Geometry, Transform
Z_2 = UnitZ(Factor=1)

# ---- group: Initial TCP
panel = Panel("429.095")

# ----
addition = Addition(A=panel, B=number_slider)

# ---- group: Initial TCP (continued)
pt = ConstructPoint(XCoordinate="-256.637", YCoordinate="7.902", ZCoordinate=addition)

# ----
vec2pt = Vector2Pt(PointA=xy, PointB=pt, Unitize=False)  # -> Vector, Length
devec = DeconstructVector(Vector=vec2pt.Vector)  # -> XComponent, YComponent, ZComponent
vec = VectorXYZ(XComponent=devec.XComponent, YComponent=devec.YComponent, ZComponent=0)  # -> Vector, Length
vdis = VectorDisplay(Anchor=xy, Vector=vec.Vector)

# ---- group: target TCP
panel_2 = Panel("411.575")

# ----
addition_2 = Addition(A=panel_2, B=number_slider)

# ---- group: target TCP (continued)
pt_2 = ConstructPoint(XCoordinate="241.802", YCoordinate="-21.579", ZCoordinate=addition_2)

# ----
vec2pt_2 = Vector2Pt(PointA=xy, PointB=pt_2, Unitize=False)  # -> Vector, Length
devec_2 = DeconstructVector(Vector=vec2pt_2.Vector)  # -> XComponent, YComponent, ZComponent
vec_2 = VectorXYZ(XComponent=devec_2.XComponent, YComponent=devec_2.YComponent, ZComponent=0)  # -> Vector, Length
angle = Angle(VectorA=vec.Vector, VectorB=vec_2.Vector)  # -> Angle, Reflex
rotate = Rotate(Geometry=vec_2.Vector, Angle=rad, Plane=xy)  # -> Geometry, Transform
rotate_2 = Rotate(Geometry=scale_nu.Geometry, Angle=angle.Angle, Plane=xy)  # -> Geometry, Transform
pl = ConstructPlane(Origin=pt_2, XAxis=rotate.Geometry, YAxis=Z_2)
gframe = GetFrame(Frame=pl)  # -> XYZLocation, ABCOrientation; disabled
pl_2 = ClusterOutput(pl)
G = ClusterOutput(rotate_2.Geometry)

# ---- group: VALUES TO BE INPUT A;B;C
panel_3 = Panel(gframe.ABCOrientation)

# ---- group: VALUES TO BE INPUT X;Y;Z
panel_4 = Panel(gframe.XYZLocation)

# ---- group: X
vdis_2 = VectorDisplay(Anchor=pt_2, Vector=rotate.Geometry)

# ---- group: Z
vdis_3 = VectorDisplay(Anchor=pt_2, Vector=vec_2.Vector)

# ---- group: Y
vdis_4 = VectorDisplay(Anchor=pt_2, Vector=Z_2)
