# Grasshopper definition Consolidated FibeWinding Syntax Preparation with polyline & syntex.gh (Grasshopper 1.0.7)
# plug-ins: Pufferfish, Bifocals

# ----
# original surface is about 76.75mm long,
# scale to match 25.5cm in length
number_slider = Slider(2, range=0..10)
# Sole Generation
surface = Surface(<surface referenced from the Rhino model>)
area = Area(Geometry=surface)  # -> Area, Centroid
scale = Scale(Geometry=surface, Center=area.Centroid, Factor=number_slider)  # -> Geometry, Transform
insole_brep_top = Brep(scale.Geometry)

surface_2 = Surface(<surface referenced from the Rhino model>)
# - Defines a gradient for the selection of anchors from an initial list.
# - Min % value defines how sparse the center is.
# - Number of sections defines in how many percentage groups are you spliting your gradient.
# - The shift moves the gradient along the curve.
area_2 = Area(Geometry=surface_2)  # -> Area, Centroid
scale_2 = Scale(Geometry=surface_2, Center=area_2.Centroid, Factor=Slider(0.9, range=0..1))  # -> Geometry, Transform
area_3 = Area(Geometry=scale_2.Geometry)  # -> Area, Centroid
scale_3 = Scale(Geometry=scale_2.Geometry, Center=area_3.Centroid, Factor=number_slider)  # -> Geometry, Transform
unit_z = UnitZ(Factor=Slider(13, range=0..100))
move = Move(Geometry=scale_3.Geometry, Motion=expr("-x", unit_z))  # -> Geometry, Transform
insole_brep_bottom = Brep(move.Geometry)

srf = Surface(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)

length_of_anchor = Slider(8, range=0..10)

anchor_length = Slider(3, range=0..10)
anchor_width = Slider(0.5, range=0..10)

number_slider_2 = Slider(1.4, range=0..10)

# ----
# Prepare for 3D printing
frame_thickness = Slider(5, range=0..10)
show_opening_frame = Brep(<brep referenced from the Rhino model>)
unit_z_2 = UnitZ(Factor=frame_thickness)
unit_z_3 = UnitZ(Factor=Slider(18, range=0..100))
move_2 = Move(Geometry=show_opening_frame, Motion=expr("-x", unit_z_3))  # -> Geometry, Transform
extrude = Extrude(Base=move_2.Geometry, Direction=expr("-x", unit_z_2))
number_slider_3 = Slider(22, range=0..100)  # disabled
number_slider_4 = Slider(3, range=0..10)  # disabled
number_slider_5 = Slider(7.05, range=0..10)  # disabled
area_4 = Area(Geometry=extrude)  # -> Area, Centroid; disabled
simple_mesh = SimpleMesh(Brep=extrude)  # disabled
unit_z_4 = UnitZ(Factor=number_slider_4)  # disabled
unit_x = UnitX(Factor=number_slider_3)  # disabled
unit_z_5 = UnitZ(Factor=number_slider_5)  # disabled
unit_x_2 = UnitX(Factor=number_slider_3)  # disabled
move_3 = Move(Geometry=area_4.Centroid, Motion=expr("-x", unit_x_2))  # -> Geometry, Transform; disabled
move_4 = Move(Geometry=area_4.Centroid, Motion=unit_x)  # -> Geometry, Transform; disabled
shoe_opening_frame_3d_printing = Mesh(simple_mesh)  # disabled
move_5 = Move(Geometry=move_4.Geometry, Motion=expr("-x", unit_z_4))  # -> Geometry, Transform; disabled
move_6 = Move(Geometry=move_3.Geometry, Motion=unit_z_5)  # -> Geometry, Transform; disabled
number_slider_6 = Slider(5, range=0..10)  # disabled
point = Point(move_5.Geometry)  # disabled
point_2 = Point(move_6.Geometry)  # disabled
number_slider_7 = Slider(45, range=0..100)  # disabled
circle = Circle(Plane=point, Radius=number_slider_6)  # disabled
circle_2 = Circle(Plane=point_2, Radius=number_slider_6)  # disabled
number_slider_8 = Slider(37, range=0..100)  # disabled
number_slider_9 = Slider(27, range=0..100)  # disabled
unit_z_6 = UnitZ(Factor=number_slider_7)  # disabled
xz_plane = XZPlane(Origin=point_2)  # disabled
unit_z_7 = UnitZ(Factor=number_slider_8)  # disabled
move_7 = Move(Geometry=circle_2, Motion=expr("-x", unit_z_6))  # -> Geometry, Transform; disabled
rotate = Rotate(Geometry=circle_2, Angle=expr("-x", degrees(number_slider_9)), Plane=xz_plane)  # -> Geometry, Transform; disabled
extrude_2 = Extrude(Base=circle, Direction=expr("-x", unit_z_7))  # disabled
loft = Loft(
    Curves=[rotate.Geometry, move_7.Geometry],
    Options={Adjust=False, Closed=False, LoftEnds=0, LoftSimp=0, LoftType=0, Rebuild=10, Refit=0.01})  # disabled
mesh = Mesh(extrude_2)  # disabled
mesh_2 = Mesh(loft)  # disabled
mesh_union = MeshUnion(Meshes=[mesh, mesh_2])  # disabled
mesh_supporting_frame = Mesh(mesh_union)  # disabled

syntax = Panel("""0
1
1
1
0
0
0
1""")
number_slider_10 = Slider(0, range=0..1000)
unit_z_8 = UnitZ(Factor=Slider(0, range=0..1000))
unit_z_9 = UnitZ(Factor=number_slider_10)
unit_z_10 = UnitZ(Factor=Slider(0, range=0..1000))
unit_z_11 = UnitZ(Factor=number_slider_10)
unit_z_12 = UnitZ(Factor=Slider(0, range=0..1000))
unit_z_13 = UnitZ(Factor=Slider(0, range=0..1000))
unit_z_14 = UnitZ(Factor=Slider(0, range=0..1000))
unit_z_15 = UnitZ(Factor=Slider(0, range=0..1000))
unit_z_16 = UnitZ(Factor=number_slider_10)
unit_z_17 = UnitZ(Factor=Slider(0, range=0..1000))
point_3 = Point()
brep = Brep(<brep referenced from the Rhino model>)
brep_2 = Brep([<brep referenced from the Rhino model> x2])

# ----
# 02 Layer Shape form front
# 02 Layer Shape form back
# 03 Profile Shaping Layer
# 04 Outer Weaving
# 05 Front Reinforce
# 06 Back Reinforce 01
# 07 Back Reinforce 02
# 08 Body Reinforce
colour_swatch = ColourSwatch(SwatchColor=RGB(0, 0, 0))

custom_preview = CustomPreview(Geometry=[brep, brep_2], Material=ColourSwatch(SwatchColor=RGB(178, 178, 178)))

# ---- group: Top : FRAME A
point_4 = Point([Point(48.89202871, 0.2230564398, 119.3737432), Point(49.58778273, 2.51007618, 118.9161175), Point(50.99811209, 4.296561891, 117.9952655), Point(52.70741461, 5.681615579, 116.8919667), Point(54.56189555, 6.792868505, 115.7125483), Point(56.50180866, 7.706098094, 114.4999536)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])

# ---- group: Bottom : FRAME B
point_5 = Point([Point(-30.19979214, 0.5607035045, 53.89670168), Point(-28.15315532, 5.916813681, 53.00884119), Point(-24.50892451, 10.29270562, 51.7103209), Point(-20.32588194, 14.11284094, 50.29190088), Point(-15.5954491, 17.28085102, 48.978662), Point(-10.53962524, 19.97504201, 47.82073351)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])

# ---- group: BODY
curve = Curve(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)

curve_2 = Curve(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)

curve_3 = Curve(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)

curve_4 = Curve(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)

curve_5 = Curve(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)

curve_6 = Curve(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)

curve_7 = Curve(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)

curve_8 = Curve(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)

curve_9 = Curve(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)

curve_10 = Curve(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)

curve_11 = Curve(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)

# ----
body = BODY(syntax_pline=curve, point=point_4, point_2=point_5)
reinf = BODY(syntax_pline=curve_9, point=point_4, point_2=point_5)
reinf_2 = BODY(syntax_pline=curve_2, point=point_4, point_2=point_5)
reinf_3 = BODY(syntax_pline=curve_3, point=point_4, point_2=point_5)
reinf_4 = BODY(syntax_pline=curve_10, point=point_4, point_2=point_5)
reinf_5 = BODY(syntax_pline=curve_4, point=point_4, point_2=point_5)
reinf_6 = BODY(syntax_pline=curve_5, point=point_4, point_2=point_5)
reinf_7 = BODY(syntax_pline=curve_11, point=point_4, point_2=point_5)
reinf_8 = BODY(syntax_pline=curve_6, point=point_4, point_2=point_5)
reinf_9 = BODY(syntax_pline=curve_7, point=point_4, point_2=point_5)
reinf_10 = BODY(syntax_pline=curve_8, point=point_4, point_2=point_5)
body_syntax = Panel(body)
body_syntax_2 = Panel(reinf_2)
body_syntax_3 = Panel(reinf)
body_syntax_4 = Panel(reinf_3)
body_syntax_5 = Panel(reinf_4)
body_syntax_6 = Panel(reinf_5)
body_syntax_7 = Panel(reinf_6)
body_syntax_8 = Panel(reinf_10)
body_syntax_9 = Panel(reinf_9)
body_syntax_10 = Panel(reinf_7)
body_syntax_11 = Panel(reinf_8)

# ----
# Insole
number_of_sections_defines_the_gradient = Slider(6, range=0..40)  # "Number of Sections (defines the gradient resolution)"
min_value = Slider(0.15, range=0..1)
construct_domain = ConstructDomain(DomainStart=1, DomainEnd=min_value)
range = Range(Domain=construct_domain, Steps=number_of_sections_defines_the_gradient)
reverse_list = ReverseList(List=range)
cull_index = CullIndex(List=reverse_list, Indices=0, Wrap=True)
merge = Merge(Data1=range, Data2=cull_index)  # -> flatten(Result)
shift_list = ShiftList(List=merge, Shift=Slider(13, range=0..100), Wrap=True)
panel = Panel("""1
0
0
0
1
0
0""")

# ----
# Insole Brep ( not the frame)
brep_wireframe = BrepWireframe(Brep=insole_brep_top, Density=-1)
brep_wireframe_2 = BrepWireframe(Brep=insole_brep_bottom, Density=-1)
number_slider_11 = Slider(100, range=0..1000)
divide_curve = DivideCurve(Curve=brep_wireframe, Count=number_slider_11, Kinks=False)  # -> Points, Tangents, Parameters
divide_curve_2 = DivideCurve(Curve=brep_wireframe_2, Count=number_slider_11, Kinks=False)  # -> Points, Tangents, Parameters
shift_list_2 = ShiftList(List=divide_curve_2.Points, Shift=Slider(90, range=0..100), Wrap=True)
line = Line(StartPoint=divide_curve.Points, EndPoint=shift_list_2)
loft_2 = Loft(Curves=line, Options={Adjust=True, Closed=True, LoftEnds=0, LoftSimp=0, LoftType=0, Rebuild=10, Refit=0.01})

# ----
# scale and move the top opening frame to
# match the transformed bottom insole
# Isolate Frame Curves
number_slider_12 = Slider(50, range=0..100)
curve_top_opening_frame = Curve(<curve referenced from the Rhino model>)
scale_4 = Scale(Geometry=curve_top_opening_frame, Center=Point(0, 0, 0), Factor=number_slider)  # -> Geometry, Transform
unit_x_3 = UnitX(Factor=number_slider_12)
move_8 = Move(Geometry=scale_4.Geometry, Motion=expr("-x", unit_x_3))  # -> Geometry, Transform
unit_z_18 = UnitZ(Factor=Slider(33, range=0..1000))
move_9 = Move(Geometry=move_8.Geometry, Motion=expr("-x", unit_z_18))  # -> Geometry, Transform
updated_curve_top_opening_frame = Curve(move_9.Geometry)
curve_insole_frame = Curve(brep_wireframe)

list_item = ListItem(List=divide_curve.Points, Index=0, Wrap=True)
list_item_2 = ListItem(List=divide_curve_2.Points, Index=0, Wrap=True)
merge_2 = Merge(Data1=divide_curve.Points, Data2=list_item)
merge_3 = Merge(Data1=divide_curve_2.Points, Data2=list_item_2)
polyline = PolyLine(Vertices=flatten(merge_2), Closed=False)
polyline_2 = PolyLine(Vertices=flatten(merge_3), Closed=False)
fragment_patch = FragmentPatch(Boundary=polyline)
fragment_patch_2 = FragmentPatch(Boundary=polyline_2)

brep_join = BrepJoin(Breps=[loft_2, fragment_patch, fragment_patch_2])  # -> flatten(Breps), Closed
panel_2 = Panel(brep_join.Breps)

# ----
# 60 Anchors on bottom insole frame
number_of_anchors = Slider(60, range=0..100)
brep_wireframe_3 = BrepWireframe(Brep=insole_brep_top, Density=-1)
divide_curve_3 = DivideCurve(Curve=brep_wireframe_3, Count=number_of_anchors, Kinks=False)  # -> Points, Tangents, Parameters
perp_frame = PerpFrame(Curve=brep_wireframe_3, Parameter=divide_curve_3.Parameters)
deconstruct_plane = DeconstructPlane(Plane=perp_frame)  # -> Origin, XAxis, YAxis, ZAxis
line_sdl = LineSDL(Start=divide_curve.Points, Direction=expr("-x", deconstruct_plane.YAxis), Length=Slider(1, range=0..1))
line_sdl_2 = LineSDL(Start=divide_curve_3.Points, Direction=expr("-x", deconstruct_plane.XAxis), Length=length_of_anchor)
line_sdl_3 = LineSDL(Start=divide_curve_3.Points, Direction=deconstruct_plane.XAxis, Length=Slider(4, range=0..10))
anchor_spacing = Slider(1, range=0..10)
join_curves = JoinCurves(Curves=[line_sdl_2, line_sdl_3], Preserve=False)
multiplication = Multiplication(A=divide_curve_3.Tangents, B=anchor_spacing)
move_10 = Move(Geometry=join_curves, Motion=expr("-x", multiplication))  # -> Geometry, Transform
move_11 = Move(Geometry=join_curves, Motion=multiplication)  # -> Geometry, Transform
end_points = EndPoints(Curve=move_11.Geometry)  # -> Start, End
end_points_2 = EndPoints(Curve=move_10.Geometry)  # -> Start, End
line_2 = Line(StartPoint=end_points.End, EndPoint=end_points_2.End)
line_3 = Line(StartPoint=end_points.Start, EndPoint=end_points_2.Start)
insole_brep_top_as_frame = Brep(insole_brep_top)
join_curves_2 = JoinCurves(Curves=[line_2, line_3, move_11.Geometry, move_10.Geometry], Preserve=False)
brep_wireframe_4 = BrepWireframe(Brep=insole_brep_top_as_frame, Density=-1)
project = Project(Curve=join_curves_2, Brep=insole_brep_top_as_frame, Direction=Vector(0, 0, 1))
multiplication_2 = Multiplication(A=number_of_anchors, B="2")
divide_curve_4 = DivideCurve(Curve=brep_wireframe_4, Count=multiplication_2, Kinks=False)  # -> Points, Tangents, Parameters
panel_3 = Panel(project)
curve_curve = CurveCurve(CurveA=project, CurveB=brep_wireframe_4)  # -> Points, ParamsA, ParamsB
shift_list_3 = ShiftList(List=divide_curve_4.Points, Shift=1, Wrap=True)
list_item_3 = ListItem(List=curve_curve.Points, Index=0, Wrap=True)  # -> Item, Item1
point_list = PointList(Points=shift_list_3)
cull_nth = CullNth(List=shift_list_3, CullFrequency=2)  # -> graft(List)
point_6 = Point(list_item_3.Item1)
point_7 = Point(list_item_3.Item)
panel_4 = Panel("""0
2
1""")
shift_list_4 = ShiftList(List=flatten(point_6), Shift=1, Wrap=True)  # -> graft(List)
line_4 = Line(StartPoint=point_7, EndPoint=shift_list_4)
weave = Weave(Pattern=panel_4, Stream0=point_7, Stream1=shift_list_4, Stream2=cull_nth, NullGaps=False)
nurbs_curve = NurbsCurve(Vertices=weave, Degree=Slider(2, range=0..10), Periodic=False)  # -> Curve, Length, Domain
panel_5 = Panel(nurbs_curve.Curve)
list_item_4 = ListItem(List=flatten(nurbs_curve.Curve), Index=0, Wrap=True)  # disabled

# ----
# 60 anchors on shoe opening frame
curve_5mm_offset_from_the_updated_curve = Curve(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)
# PROTOTYPE MODEL
length = Length(Curve=curve_5mm_offset_from_the_updated_curve)
division = Division(A=length, B=number_of_anchors)
divide_curve_5 = DivideCurve(Curve=curve_5mm_offset_from_the_updated_curve, Count=number_of_anchors, Kinks=False)  # -> Points, Tangents, Parameters
multiplication_3 = Multiplication(A=number_of_anchors, B="2")
perp_frame_2 = PerpFrame(Curve=curve_5mm_offset_from_the_updated_curve, Parameter=divide_curve_5.Parameters)
divide_curve_6 = DivideCurve(Curve=curve_5mm_offset_from_the_updated_curve, Count=multiplication_3, Kinks=False)  # -> Points, Tangents, Parameters
deconstruct_plane_2 = DeconstructPlane(Plane=perp_frame_2)  # -> Origin, XAxis, YAxis, ZAxis
point_8 = Point(divide_curve_6.Points)
shift_list_5 = ShiftList(List=point_8, Shift=Slider(1, range=0..10), Wrap=True)
cull_nth_2 = CullNth(List=shift_list_5, CullFrequency=2)
multiplication_4 = Multiplication(A=divide_curve_5.Tangents, B=anchor_width)
line_sdl_4 = LineSDL(Start=divide_curve_5.Points, Direction=deconstruct_plane_2.XAxis, Length=anchor_length)
point_9 = Point(cull_nth_2)
move_12 = Move(Geometry=line_sdl_4, Motion=expr("-x", multiplication_4))  # -> Geometry, Transform
move_13 = Move(Geometry=line_sdl_4, Motion=multiplication_4)  # -> Geometry, Transform
point_list_2 = PointList(Points=point_9, Size=0.5)
end_points_3 = EndPoints(Curve=move_12.Geometry)  # -> Start, End
end_points_4 = EndPoints(Curve=move_13.Geometry)  # -> Start, End
point_10 = Point(end_points_4.End)
point_11 = Point(end_points_3.End)
line_5 = Line(StartPoint=end_points_4.End, EndPoint=end_points_3.End)
point_list_3 = PointList(Points=point_11, Size=0.5)
point_list_4 = PointList(Points=point_10, Size=0.5)
panel_6 = Panel("""0
1
2""")

# ----
# trimmed surfacce
number_slider_13 = Slider(100, range=0..100)
updated_curve_top_opening_frame_2 = Curve(updated_curve_top_opening_frame)
divide_curve_7 = DivideCurve(Curve=updated_curve_top_opening_frame_2, Count=number_slider_13, Kinks=False)  # -> Points, Tangents, Parameters
divide_curve_8 = DivideCurve(Curve=curve_5mm_offset_from_the_updated_curve, Count=number_slider_13, Kinks=False)  # -> Points, Tangents, Parameters
polyline_3 = PolyLine(Vertices=flatten(divide_curve_7.Points), Closed=False)
polyline_4 = PolyLine(Vertices=flatten(divide_curve_8.Points), Closed=False)
fragment_patch_3 = FragmentPatch(Boundary=polyline_3)
fragment_patch_4 = FragmentPatch(Boundary=polyline_4)
area_5 = Area(Geometry=fragment_patch_3)  # -> Area, Centroid
scale_5 = Scale(Geometry=polyline_3, Center=area_5.Centroid, Factor=Slider(0.53, range=0..1))  # -> Geometry, Transform
project_2 = Project(Curve=scale_5.Geometry, Brep=fragment_patch_4, Direction=Vector(0, 0, 1))
fragment_patch_5 = FragmentPatch(Boundary=project_2)
unit_z_19 = UnitZ(Factor=1)
multiplication_5 = Multiplication(A=unit_z_19, B=Slider(0.5, range=0..1))
extrude_3 = Extrude(Base=fragment_patch_5, Direction=unit_z_19)
move_14 = Move(Geometry=extrude_3, Motion=expr("-x", multiplication_5))  # -> Geometry, Transform
trim_solid = TrimSolid(Shape=fragment_patch_4, Cutters=move_14.Geometry)
brep_wireframe_5 = BrepWireframe(Brep=trim_solid, Density=-1)
panel_7 = Panel(brep_wireframe_5)

# ----
# Bottom Frame Curve
# Top Frame Curve
anchor_points_count = Slider(60, range=0..100)
# Anchor Points
bottom_frame_curve = Curve(simplify(curve_insole_frame))
top_frame_curve = Curve(simplify(updated_curve_top_opening_frame))
anchor_points_count_2 = Number(anchor_points_count)
flip = BooleanToggle(False)
flip_2 = BooleanToggle(True)
alignseam = AlignCurveSeam(frame_curves=[bottom_frame_curve, top_frame_curve], flip_seam_boolean=flip)  # -> aligned_top_curve_2, aligned_bottom_curve_2, seam_points_2
alignseam_2 = AlignCurveSeam(frame_curves=[bottom_frame_curve, top_frame_curve], flip_seam_boolean=flip_2)  # -> aligned_top_curve_2, aligned_bottom_curve_2, seam_points_2
subcurve_selection_domain = Slider(0.622, range=0..1)
asymmetry_correction_shift = Slider(0, range=0..10)

number_slider_14 = Slider(0.21, range=0..1)
pt = Point(divide_curve_5.Points)
subtraction = Subtraction(A="1", B=number_slider_14)
midpt = CurveMiddle()
line_6 = Line(StartPoint=end_points_4.Start, EndPoint=end_points_3.Start)
eval = EvaluateCurve(Curve=reparameterize(line_6), Parameter=subtraction)  # -> Point, Tangent, Angle
eval_2 = EvaluateCurve(Curve=reparameterize(line_6), Parameter=number_slider_14)  # -> Point, Tangent, Angle
line_7 = Line(StartPoint=eval_2.Point, EndPoint=end_points_4.End)
line_8 = Line(StartPoint=eval.Point, EndPoint=end_points_3.End)

shift_list_6 = ShiftList(List=eval.Point, Shift=1, Wrap=True)
weave_2 = Weave(Pattern=panel_6, Stream0=graft(eval_2.Point), Stream1=graft(point_9), Stream2=graft(shift_list_6), NullGaps=False)
nurbs_curve_2 = NurbsCurve(Vertices=weave_2, Degree=Slider(2, range=0..10), Periodic=False)  # -> Curve, Length, Domain
join_curves_3 = JoinCurves(Curves=[line_5, nurbs_curve_2.Curve], Preserve=False)
panel_8 = Panel(join_curves_3)

bake_in_rhino_and_use_it_to_trim_the_bre = Curve(join_curves_3)  # "bake in rhino and use it to trim the brep"
bake_in_rhino_and_to_be_trimmed = Brep(trim_solid)

subcurve_selection_domain_2 = Slider(0.655, range=0..1)
asymmetry_correction_shift_2 = Slider(0, range=0..10)
subcurve_selection_domain_3 = Slider(0.801, range=0..1)
asymmetry_correction_shift_3 = Slider(0, range=0..10)
subcurve_selection_domain_4 = Slider(0.66, range=0..1)
asymmetry_correction_shift_4 = Slider(0, range=0..10)

# ---- group: Frames and Anchor Points
divide = DivideCurve(AlignedBottomCurve=alignseam.aligned_bottom_curve_2, Count=anchor_points_count_2, Kinks=False)  # -> Points, Tangents, Parameters
divide_2 = DivideCurve(AlignedTopCurve=alignseam.aligned_top_curve_2, Count=anchor_points_count_2, Kinks=False)  # -> Points, Tangents, Parameters
point_list_5 = PointList(Points=divide_2.Points, Size=number_slider_2)
point_list_6 = PointList(Points=divide.Points, Size=number_slider_2)

# ----
points_on_bottom_frame = Point(divide.Points)
points_on_top_frame = Point(divide_2.Points)

point_list_7 = PointList(Points=points_on_bottom_frame, Size=1)

subanchors = AnchorPointsSelector(
    anchor_points_frame_a=divide_2.Points,
    base_curves=[alignseam.aligned_top_curve_2, alignseam.aligned_bottom_curve_2],
    subcurve_selection_domain=subcurve_selection_domain_2,
    anchor_points_frame_b=divide.Points,
    asymmetry_correction_shift=asymmetry_correction_shift_2)  # -> top_frame_point_selection_2, bottom_frame_point_selection_2
subanchors_2 = AnchorPointsSelector(
    anchor_points_frame_a=divide_2.Points,
    base_curves=[alignseam_2.aligned_top_curve_2, alignseam_2.aligned_bottom_curve_2],
    subcurve_selection_domain=subcurve_selection_domain_3,
    anchor_points_frame_b=divide.Points,
    asymmetry_correction_shift=asymmetry_correction_shift_3)  # -> top_frame_point_selection_2, bottom_frame_point_selection_2
subanchors_3 = AnchorPointsSelector(
    anchor_points_frame_a=divide_2.Points,
    base_curves=[alignseam.aligned_top_curve_2, alignseam.aligned_bottom_curve_2],
    subcurve_selection_domain=subcurve_selection_domain_3,
    anchor_points_frame_b=divide.Points,
    asymmetry_correction_shift=asymmetry_correction_shift_3)  # -> top_frame_point_selection_2, bottom_frame_point_selection_2
subanchors_4 = AnchorPointsSelector(
    anchor_points_frame_a=divide_2.Points,
    base_curves=[alignseam_2.aligned_top_curve_2, alignseam_2.aligned_bottom_curve_2],
    subcurve_selection_domain=subcurve_selection_domain_4,
    anchor_points_frame_b=divide.Points,
    asymmetry_correction_shift=asymmetry_correction_shift_4)  # -> top_frame_point_selection_2, bottom_frame_point_selection_2
pt_2 = Point(subanchors.top_frame_point_selection_2)
pt_3 = Point(subanchors.bottom_frame_point_selection_2)
pt_4 = Point(subanchors_2.bottom_frame_point_selection_2)
pt_5 = Point(subanchors_3.bottom_frame_point_selection_2)
pt_6 = Point(subanchors_4.bottom_frame_point_selection_2)

subanchors_5 = AnchorPointsSelector(
    anchor_points_frame_a=divide_2.Points,
    base_curves=[alignseam.aligned_top_curve_2, alignseam.aligned_bottom_curve_2],
    subcurve_selection_domain=subcurve_selection_domain,
    anchor_points_frame_b=divide.Points,
    asymmetry_correction_shift=asymmetry_correction_shift)  # -> top_frame_point_selection_2, bottom_frame_point_selection_2
subanchors_6 = AnchorPointsSelector(
    anchor_points_frame_a=divide_2.Points,
    base_curves=[alignseam_2.aligned_top_curve_2, alignseam_2.aligned_bottom_curve_2],
    subcurve_selection_domain=subcurve_selection_domain,
    anchor_points_frame_b=divide.Points,
    asymmetry_correction_shift=asymmetry_correction_shift)  # -> top_frame_point_selection_2, bottom_frame_point_selection_2
pt_7 = Point(subanchors_5.top_frame_point_selection_2)
pt_8 = Point(subanchors_5.bottom_frame_point_selection_2)
pt_9 = Point(subanchors_6.top_frame_point_selection_2)
pt_10 = Point(subanchors_6.bottom_frame_point_selection_2)

panel_9 = Panel("""FALSE
FALSE
FALSE
FALSE
FALSE
TRUE
TRUE
TRUE""")
shift = Slider(14, range=-1..50)
cull_pattern = CullPattern(List=divide_2.Points, CullPattern=panel_9)
cull_pattern_2 = CullPattern(List=divide.Points, CullPattern=panel_9)
c__shift_approach = CSharpScript(iShift=shift, iPointsA=flatten(cull_pattern), iPointsB=flatten(cull_pattern_2))  # -> out, oFinalPoints; inputs iShift: Int32, iPointsA: list of Point3d, iPointsB: list of Point3d
# ---------- c__shift_approach: C# ----------
    int iPointsACount = iPointsA.Count;
    int iPointsBCount = iPointsB.Count;
    int maxPoints = iPointsACount;

    // create frame objects

    Frame frameA = new Frame(iPointsA);
    Frame frameB = new Frame(iPointsB);


    // determine smaller frame

    if (iPointsACount < iPointsBCount){
      // a is smaller
      frameA.isSmaller = true;
      maxPoints = iPointsBCount;
      frameA.maxPoints = maxPoints;
      frameA.insertPoints();
      Print("Frame A is smaller");
    }

    else if (iPointsBCount < iPointsACount){
      // b is smaller
      frameB.isSmaller = true;
      maxPoints = iPointsACount;
      frameB.maxPoints = maxPoints;
      frameB.insertPoints();
      Print("Frame B is smaller");
    }

    // create selectors

    List < int > selectA = new List<int>(){0};
    List < int> selectB = new List<int>(){iShift};

    int selectorA = 0;
    int selectorB = 0;

    for (int i = 0; i < maxPoints; i++){

      selectorA = (selectorA + iShift * 2) % maxPoints;

      if(selectA.Contains(selectorA))
        selectorA += 1;

      selectA.Add(selectorA);

      selectorB = (selectorA + iShift) % maxPoints;

      if(selectB.Contains(selectorB))
        selectorB += 1;

      selectB.Add(selectorB);

    }


    // select and weave points

    List<Point3d> finalPoints = new List<Point3d>();

    for (int i = 0; i < maxPoints; i++){

      finalPoints.Add(frameA.windingPins[selectA[i]]);
      finalPoints.Add(frameB.windingPins[selectB[i]]);
    }


    oFinalPoints = finalPoints;
# ---------- c__shift_approach: C# additional code ----------
  class Frame{

    public bool isSmaller;
    public int maxPoints;
    int length;
    public List<int>duplicatePositions;
    public List<Point3d> windingPins;

    // constructor
    public Frame(List<Point3d>_windingPins){

      isSmaller = false;
      windingPins = _windingPins;
      length = windingPins.Count;

    }

    public void insertPoints(){

      // generate list of positions

      int space = 5;
      duplicatePositions = new List<int>();

      for (int i = 0; i < length; i++){

        if(i % space == 0){
          duplicatePositions.Add(i);
        }
      }

      for(int i = 0; i < duplicatePositions.Count; i++){

        int pos = duplicatePositions[i] + i;
        Point3d dupValue = windingPins[pos];
        windingPins.Insert(pos, dupValue);

      }
    }
  }
# ---------- end c__shift_approach ----------
polyline_5 = PolyLine(Vertices=c__shift_approach.oFinalPoints, Closed=True)
sub_curve = SubCurve(BaseCurve=reparameterize(polyline_5), Domain=Slider(1, range=0..1))

shift_list_7 = ShiftList(List=divide.Points, Shift=Slider(7, range=0..10), Wrap=True)
gene_pool = GenePool(Decimals=0, Maximum=1, Minimum=0, Value=[0, 1, 1, 1, 0, 0, 0, 1])
weave_3 = Weave(Pattern=gene_pool, Stream0=divide_2.Points, Stream1=shift_list_7, NullGaps=False)
weave_4 = Weave(Pattern=gene_pool, Stream0=divide_2.Points, Stream1=divide.Points, NullGaps=False)
polyline_6 = PolyLine(Vertices=flatten(weave_4), Closed=False)
polyline_7 = PolyLine(Vertices=flatten(weave_3), Closed=False)

c__shift_approach_2 = CSharpScript(iShift=Slider(15, range=0..100), iPointsA=flatten(divide_2.Points), iPointsB=flatten(divide.Points))  # -> out, oFinalPoints; inputs iShift: Int32, iPointsA: list of Point3d, iPointsB: list of Point3d; same code as c__shift_approach
polyline_8 = PolyLine(Vertices=flatten(c__shift_approach_2.oFinalPoints), Closed=True)
cluster = Cluster(base_curve=polyline_8, domain=Slider(1, range=0..1))  # -> visual, curve

point_12 = Point(pt_4)
list_length = ListLength(List=point_12)
division_2 = Division(A=list_length, B=2)
round = Round(Number=division_2)  # -> Nearest, Floor, Ceiling
split_list = SplitList(List=point_12, Index=round.Floor)  # -> ListA, ListB
gene_pool_2 = GenePool(Decimals=0, Maximum=1, Minimum=0, Value=[0, 1, 0, 1])
cull_index_2 = CullIndex(List=split_list.ListB, Indices=0, Wrap=True)
point_13 = Point(reverse(cull_index_2))
point_14 = Point(split_list.ListA)
gene_pool_3 = GenePool(Decimals=0, Maximum=1, Minimum=0, Value=[0, 1, 1, 0])
cull_pattern_3 = CullPattern(List=point_14, CullPattern=gene_pool_2)
cull_pattern_4 = CullPattern(List=point_13, CullPattern=gene_pool_2)
weave_5 = Weave(Pattern=gene_pool_3, Stream0=cull_pattern_3, Stream1=cull_pattern_4, NullGaps=False)
polyline_9 = PolyLine(Vertices=flatten(weave_5), Closed=False)
cluster_2 = Cluster(base_curve=polyline_9, domain=Slider(1, range=0..1))  # -> visual, curve

# ---- group: Frames and Anchor Points (continued)
custom_preview_2 = CustomPreview(
    Geometry=[polyline_9, bottom_frame_curve, top_frame_curve, divide_2.Points, divide.Points],
    Material=ColourSwatch(SwatchColor=RGB(186, 186, 186)))

# ----
point_15 = Point(pt_5)
list_length_2 = ListLength(List=point_15)
division_3 = Division(A=list_length_2, B=2)
round_2 = Round(Number=division_3)  # -> Nearest, Floor, Ceiling
gene_pool_4 = GenePool(Decimals=0, Maximum=1, Minimum=0, Value=[0, 1, 0, 1])
split_list_2 = SplitList(List=point_15, Index=round_2.Floor)  # -> ListA, ListB
cull_index_3 = CullIndex(List=split_list_2.ListB, Indices=0, Wrap=True)
point_16 = Point(reverse(cull_index_3))
point_17 = Point(split_list_2.ListA)
gene_pool_5 = GenePool(Decimals=0, Maximum=1, Minimum=0, Value=[0, 1, 1, 0])
cull_pattern_5 = CullPattern(List=point_17, CullPattern=gene_pool_4)
cull_pattern_6 = CullPattern(List=point_16, CullPattern=gene_pool_4)
weave_6 = Weave(Pattern=gene_pool_5, Stream0=cull_pattern_5, Stream1=cull_pattern_6, NullGaps=False)
polyline_10 = PolyLine(Vertices=flatten(weave_6), Closed=False)
cluster_3 = Cluster(base_curve=polyline_10, domain=Slider(1, range=0..1))  # -> visual, curve

# ----
# 01 Layer Front
point_18 = Point(pt_9)
point_19 = Point(pt_10)
gene_pool_6 = GenePool(Decimals=0, Maximum=1, Minimum=0, Value=[0.5, 1])
weave_7 = Weave(Pattern=gene_pool_6, Stream0=point_18, Stream1=point_19, NullGaps=False)
# Syntax
polyline_11 = PolyLine(Vertices=flatten(weave_7), Closed=False)
cluster_4 = Cluster(base_curve=polyline_11, domain=Slider(1, range=0..1))  # -> visual, curve

custom_preview_3 = CustomPreview(Geometry=cluster_4.curve, Material=ColourSwatch(SwatchColor=RGB(255, 233, 31)))
move_15 = Move(Geometry=polyline_10, Motion=unit_z_10)  # -> Geometry, Transform
move_16 = Move(Geometry=polyline_9, Motion=unit_z_8)  # -> Geometry, Transform
move_17 = Move(Geometry=polyline_5, Motion=unit_z_13)  # -> Geometry, Transform
move_18 = Move(Geometry=polyline_7, Motion=unit_z_14)  # -> Geometry, Transform
move_19 = Move(Geometry=polyline_6, Motion=unit_z_15)  # -> Geometry, Transform
move_20 = Move(Geometry=polyline_8, Motion=unit_z_17)  # -> Geometry, Transform

# ---- group: BODY
# LAYERS AND FRAMES
curve_12 = Curve(polyline_11)

curve_13 = Curve(polyline_9)

curve_14 = Curve(polyline_10)

curve_15 = Curve(polyline_8)

curve_16 = Curve(polyline_6)

curve_17 = Curve(polyline_7)

curve_18 = Curve(sub_curve)

# ---- group: Top : FRAME A
point_20 = Point(divide_2.Points)

# ---- group: Bottom : FRAME B
point_21 = Point(divide.Points)

# ----
body_2 = BODY(syntax_pline=curve_12, point=point_20, point_2=point_21)
reinf_11 = BODY(syntax_pline=curve_13, point=point_20, point_2=point_21)
reinf_12 = BODY(syntax_pline=curve_14, point=point_20, point_2=point_21)
reinf_13 = BODY(syntax_pline=curve_15, point=point_20, point_2=point_21)
reinf_14 = BODY(syntax_pline=curve_16, point=point_20, point_2=point_21)
reinf_15 = BODY(syntax_pline=curve_17, point=point_20, point_2=point_21)
reinf_16 = BODY(syntax_pline=curve_18, point=point_20, point_2=point_21)
syntax_2 = Panel(reinf_11)
body_syntax_12 = Panel(reinf_12)
syntax_3 = Panel(reinf_13)
body_syntax_13 = Panel(reinf_14)
body_syntax_14 = Panel(reinf_15)
body_syntax_15 = Panel(reinf_16)
syntax_4 = Panel(body_2)

# ---- group: Frame B
list_indices = ListIndices(List=point_21)
concatenate = Concatenate(FragmentA=list_indices, FragmentB="B")
concatenate_2 = Concatenate(FragmentA=concatenate, FragmentB=point_21)

# ---- group: Frame A
# SYNTAX  LIST AND
# ANCHOR'S POSITIONS
list_indices_2 = ListIndices(List=point_20)
concatenate_3 = Concatenate(FragmentA=list_indices_2, FragmentB="A")
concatenate_4 = Concatenate(FragmentA=concatenate_3, FragmentB=point_20)

# ----
anchors_coordinates_frame_a = Panel(concatenate_4)
anchors_coordinates_frame_b = Panel(concatenate_2)

points_on_bottom_frame_2 = Point(points_on_bottom_frame)
nurbs_curve_3 = NurbsCurve(Vertices=points_on_bottom_frame_2, Degree=3, Periodic=False)  # -> Curve, Length, Domain
list_length_3 = ListLength(List=points_on_bottom_frame_2)
division_4 = Division(A=list_length_3, B="2")
split_list_3 = SplitList(List=points_on_bottom_frame_2, Index=division_4)  # -> ListA, ListB
point_22 = Point(split_list_3.ListB)
point_23 = Point(split_list_3.ListA)
list_length_4 = ListLength(List=point_23)
list_length_5 = ListLength(List=point_22)
list_length_6 = ListLength(List=point_23)
list_length_7 = ListLength(List=point_23)
random = Random(Range=list_length_4, Number=1, Seed=Slider(22, range=0..100))
random_2 = Random(Range=list_length_5, Number=1, Seed=Slider(52, range=0..100))
random_3 = Random(Range=list_length_6, Number=1, Seed=Slider(22, range=0..100))
random_4 = Random(Range=list_length_7, Number=1, Seed=Slider(2, range=0..10))
shift_list_8 = ShiftList(List=point_23, Shift=random, Wrap=True)
shift_list_9 = ShiftList(List=point_22, Shift=random_2, Wrap=True)
shift_list_10 = ShiftList(List=point_23, Shift=random_3, Wrap=True)
c__x_approach = CSharpScript(AnchorsCount=list_length_7, Anchors_A=point_23, Anchors_B=point_22, shift=random_4)  # -> out, finalList; inputs AnchorsCount: Int32, Anchors_A: list of Point3d, Anchors_B: list of Point3d, shift: Int32
# ---------- c__x_approach: C# ----------
    List<Point3d> FinalAnchors = new List<Point3d>();


    for (int i = 0; i < AnchorsCount - shift; i++){

      Point3d a = Anchors_A[i];
      Point3d b = Anchors_B[i + shift];
      Point3d c = Anchors_B[i];
      Point3d d = Anchors_A[i + shift];
      FinalAnchors.Add(a);
      FinalAnchors.Add(b);
      FinalAnchors.Add(c);
      FinalAnchors.Add(d);

    }

    finalList = FinalAnchors;
# ---------- end c__x_approach ----------
c__gradientanchorselection = CSharpScript(initPointsA=point_23, initPointsB=point_22, secList=shift_list)  # -> out, oSelectedIndicesA, oSelectedPointsA, oSelectedIndicesB, oSelectedPointsB; inputs initPointsA: list of Point3d, initPointsB: list of Point3d, secList: list of Double
# ---------- c__gradientanchorselection: C# usings ----------
using System.IO;
using System.Text.RegularExpressions;
using System.Linq;
# ---------- c__gradientanchorselection: C# ----------
    //___________ This script selects two lists of points based on a gradient list defined by the user_________
    //___________ re_duque_11/04/22___________________________________________________________________________


    double numPoints = initPointsA.Count(); //total number of points in initPoints
    double numSection = secList.Count();
    List<int> SelectedPointsIndicesA = new List<int>();
    List<Point3d> SelectedPointsA = new List<Point3d>();
    List<int> SelectedPointsIndicesB = new List<int>();
    List<Point3d> SelectedPointsB = new List<Point3d>();
    int i = 0;

    Print("numSection=" + numSection.ToString());

    while (i < numPoints) // go through the list until reaches its end without defining the step size
    {

      Print("i=" + i.ToString());

      // add the i to the list
      SelectedPointsA.Add(initPointsA[i]); //adds current Point
      SelectedPointsIndicesA.Add(i); // adds current index
      SelectedPointsB.Add(initPointsB[i]); //adds current Point
      SelectedPointsIndicesB.Add(i);

      // which section are we in? Remap the indexes to their respective sections
      int mySection = (int) Math.Floor(i / numPoints * numSection); // i/numPoints gives the relative position of the index in the list.  (Math.Floor rounds down the number)

      Print("mySection=" + mySection.ToString());

      //what is the section density? calculate the skip factor: Density/1
      int skip = (int) Math.Round(1 / secList[mySection]); // secList[mySection] gives the skip value based on the list you defined with the densitity ratios

      // gets i value

      i = i + skip;


    }


    oSelectedPointsA = SelectedPointsA;
    oSelectedIndicesA = SelectedPointsIndicesA;

    oSelectedPointsB = SelectedPointsB;
    oSelectedIndicesB = SelectedPointsIndicesB;
# ---------- end c__gradientanchorselection ----------
line_9 = Line(StartPoint=point_22, EndPoint=shift_list_8)
line_10 = Line(StartPoint=point_22, EndPoint=shift_list_9)
line_11 = Line(StartPoint=point_23, EndPoint=shift_list_10)
point_24 = Point(c__x_approach.finalList)
point_25 = Point(c__gradientanchorselection.oSelectedPointsA)
point_26 = Point(c__gradientanchorselection.oSelectedPointsB)
explode = Explode(Curve=line_9, Recursive=True)  # -> Segments, Vertices
explode_2 = Explode(Curve=line_10, Recursive=True)  # -> Segments, Vertices
explode_3 = Explode(Curve=line_11, Recursive=True)  # -> Segments, Vertices
list_length_8 = ListLength(List=point_25)
weave_8 = Weave(Pattern=panel, Stream0=point_25, Stream1=point_26, NullGaps=False)
random_5 = Random(Range=list_length_8, Number=1, Seed=Slider(38, range=0..100))
shift_list_11 = ShiftList(List=point_25, Shift=random_5, Wrap=True)
line_12 = Line(StartPoint=shift_list_11, EndPoint=point_26)
explode_4 = Explode(Curve=line_12, Recursive=True)  # -> Segments, Vertices

polyline_12 = PolyLine(Vertices=flatten(point_24), Closed=False)
polyline_13 = PolyLine(Vertices=flatten(explode_4.Vertices), Closed=False)
polyline_14 = PolyLine(Vertices=flatten(explode.Vertices), Closed=False)
polyline_15 = PolyLine(Vertices=flatten(explode_2.Vertices), Closed=False)
polyline_16 = PolyLine(Vertices=flatten(explode_3.Vertices), Closed=False)

geometry = Geometry([polyline_12, polyline_13, polyline_14, polyline_15, polyline_16])

shift_list_12 = ShiftList(List=pt_8, Shift=Slider(8, range=0..20), Wrap=True)

# ---- group: Back Reinforce
line_13 = Line(StartPoint=pt_8, EndPoint=shift_list_12)
explode_5 = Explode(Curve=line_13, Recursive=True)  # -> Segments, Vertices
polyline_17 = PolyLine(Vertices=flatten(explode_5.Vertices), Closed=False)

# ----
cluster_5 = Cluster(base_curve=polyline_17, domain=Slider(1, range=0..1))  # -> visual, curve

move_21 = Move(Geometry=polyline_17, Motion=unit_z_11)  # -> Geometry, Transform

# ---- group: BODY
curve_19 = Curve(polyline_17)

# ----
reinf_17 = BODY(syntax_pline=curve_19, point=point_20, point_2=point_21)
body_syntax_16 = Panel(reinf_17)

shift_list_13 = ShiftList(List=pt_8, Shift=Slider(9, range=0..20), Wrap=True)

# ---- group: Back Reinforce
line_14 = Line(StartPoint=pt_7, EndPoint=shift_list_13)
explode_6 = Explode(Curve=line_14, Recursive=True)  # -> Segments, Vertices
polyline_18 = PolyLine(Vertices=flatten(explode_6.Vertices), Closed=False)

# ----
cluster_6 = Cluster(base_curve=polyline_18, domain=Slider(1, range=0..1))  # -> visual, curve

move_22 = Move(Geometry=polyline_18, Motion=unit_z_9)  # -> Geometry, Transform

# ---- group: BODY
curve_20 = Curve(polyline_18)

# ----
reinf_18 = BODY(syntax_pline=curve_20, point=point_20, point_2=point_21)
body_syntax_17 = Panel(reinf_18)

shift_list_14 = ShiftList(List=pt_6, Shift=Slider(7, range=0..20), Wrap=True)

# ---- group: Front Reinforce
line_15 = Line(StartPoint=pt_6, EndPoint=shift_list_14)
explode_7 = Explode(Curve=line_15, Recursive=True)  # -> Segments, Vertices
polyline_19 = PolyLine(Vertices=flatten(explode_7.Vertices), Closed=False)

# ----
cluster_7 = Cluster(base_curve=polyline_19, domain=Slider(1, range=0..1))  # -> visual, curve

move_23 = Move(Geometry=polyline_19, Motion=unit_z_16)  # -> Geometry, Transform

# ---- group: BODY
curve_21 = Curve(polyline_19)

# ----
reinf_19 = BODY(syntax_pline=curve_21, point=point_20, point_2=point_21)
body_syntax_18 = Panel(reinf_19)

# ----
# 01 Layer Side & Back
number_slider_15 = Slider(18, range=0..20)
number_slider_16 = Slider(10, range=0..20)
point_27 = Point(pt_3)
point_28 = Point(pt_2)
shift_list_15 = ShiftList(List=point_28, Shift=number_slider_15, Wrap=True)
shift_list_16 = ShiftList(List=point_27, Shift=number_slider_16, Wrap=True)
gene_pool_7 = GenePool(Decimals=0, Maximum=1, Minimum=0, Value=[0.5, 1])

shift_list_17 = ShiftList(List=shift_list_15, Shift=number_slider_16, Wrap=True)

weave_9 = Weave(Pattern=gene_pool_7, Stream0=shift_list_17, Stream1=shift_list_16, NullGaps=False)
polyline_20 = PolyLine(Vertices=flatten(weave_9), Closed=False)
cluster_8 = Cluster(base_curve=polyline_20, domain=Slider(1, range=0..1))  # -> visual, curve

move_24 = Move(Geometry=[polyline_11, polyline_20], Motion=unit_z_12)  # -> Geometry, Transform

colour_swatch_2 = ColourSwatch(SwatchColor=RGB(153, 153, 153))
colour_swatch_3 = ColourSwatch(SwatchColor=RGB(89, 160, 189))
colour_swatch_4 = ColourSwatch(SwatchColor=RGB(0, 0, 0))
custom_preview_4 = CustomPreview(Geometry=move_21.Geometry, Material=colour_swatch_4)
custom_preview_5 = CustomPreview(Geometry=move_24.Geometry, Material=colour_swatch)
custom_preview_6 = CustomPreview(Geometry=move_20.Geometry, Material=ColourSwatch(SwatchColor=RGB(245, 215, 49)))
custom_preview_7 = CustomPreview(Geometry=polyline_20, Material=colour_swatch)
custom_preview_8 = CustomPreview(Geometry=move_16.Geometry, Material=colour_swatch_2)
custom_preview_9 = CustomPreview(Geometry=move_15.Geometry, Material=colour_swatch_2)
custom_preview_10 = CustomPreview(Geometry=move_19.Geometry, Material=colour_swatch_3)
custom_preview_11 = CustomPreview(Geometry=move_18.Geometry, Material=colour_swatch_3)
custom_preview_12 = CustomPreview(Geometry=move_23.Geometry, Material=colour_swatch_4)
custom_preview_13 = CustomPreview(Geometry=sub_curve, Material=ColourSwatch(SwatchColor=RGB(10, 0, 0)))
custom_preview_14 = CustomPreview(Geometry=move_22.Geometry, Material=colour_swatch_4)

# ---- group: BODY
curve_22 = Curve(polyline_20)

# ----
reinf_20 = BODY(syntax_pline=curve_22, point=point_20, point_2=point_21)
body_syntax_19 = Panel(reinf_20)

# ----
# bake in Rhino and trim with the
# original frame brep, and refer
# the new brep (with the anchors) here
insole_frame_thickness = Slider(0.6, range=0..1)  # disabled
merge_4 = Merge(Data1=project, Data2=nurbs_curve.Curve)  # disabled
join_curves_4 = JoinCurves(Curves=flatten(merge_4), Preserve=False)  # disabled
number_slider_17 = Slider(5, range=0..10)  # disabled
unit_z_20 = UnitZ(Factor=insole_frame_thickness)  # disabled
brep_3 = Brep(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)  # disabled
extrude_4 = Extrude(Base=brep_3, Direction=unit_z_20)  # disabled
unit_z_21 = UnitZ(Factor=number_slider_17)  # disabled

explode_8 = Explode(Curve=join_curves_4, Recursive=True)  # -> Segments, Vertices; disabled
polyline_21 = PolyLine(Vertices=flatten(explode_8.Vertices), Closed=False)  # disabled
patch = Patch(Curves=polyline_21, Spans=20, Flexibility=1, Trim=True)  # disabled
fragment_patch_6 = FragmentPatch(Boundary=polyline_21)  # disabled
extrude_5 = Extrude(Base=polyline_21, Direction=unit_z_21)  # disabled

panel_10 = Panel(fragment_patch_6)  # disabled
move_25 = Move(Geometry=fragment_patch_6, Motion=unit_z_21)  # -> Geometry, Transform; disabled

to_bake = Geometry([move_25.Geometry, fragment_patch_6])  # disabled
brep_4 = Brep([to_bake, extrude_5])  # disabled

brep_join_2 = BrepJoin(Breps=brep_4)  # -> Breps, Closed; disabled
simple_mesh_2 = SimpleMesh(Brep=brep_join_2.Breps)  # disabled
insole_frame_mesh_3d_print = Mesh(simple_mesh_2)  # disabled
panel_11 = Panel(insole_frame_mesh_3d_print)  # disabled

# ----
# Winding Frame(Mesh for 3D Printing)
solid_union = SolidUnion(Breps=[extrude, extrude_2, loft, brep_join_2.Breps])  # disabled

# ---- group: whole winding frame (3d print)
mesh_3 = Mesh(solid_union)  # disabled

# ----
panel_12 = Panel(mesh_3)  # disabled

# ==== cluster AlignCurveSeam: Uses a bounding box to align curve seams
frame_curves = ClusterInput()
flip_seam_boolean = ClusterInput()

frame_curves_2 = Curve(flatten(frame_curves))

# ---- group: Creating Guide Point For Alignment Of Seams
bbox = BoundingBox(FrameCurves=frame_curves_2, Plane=PlaneXY(0, 0, 0), UnionBox=True)  # -> Box, Box_2
debrep = DeconstructBrep(Brep=bbox.Box)  # -> Faces, Edges, Vertices
area = Area(Geometry=debrep.Faces)  # -> Area, Centroid
sort = SortList(Keys=area.Area, ValuesA=area.Centroid)  # -> Keys, ValuesA
item = ListItem(List=sort.ValuesA, Index=0, Wrap=True)  # -> Item, Item1

# ---- group: Enable selecting the opposite subcurve
filter = StreamFilter(FlipSeamBoolean=flip_seam_boolean, Stream0=item.Item, Stream1=item.Item1)

# ----
crv_cp = CurveClosestPoint(Point=filter, Curve=frame_curves_2)  # -> Point, Parameter, Distance
seam = Seam(Curve=frame_curves_2, Seam=crv_cp.Parameter)
item_2 = ListItem(List=seam, Index=0, Wrap=True)  # -> Item, Item1

aligned_bottom_curve = Curve(item_2.Item1)
aligned_top_curve = Curve(item_2.Item)
seam_points = Point(crv_cp.Point)
seam_points_2 = ClusterOutput(seam_points)
aligned_top_curve_2 = ClusterOutput(aligned_top_curve)
aligned_bottom_curve_2 = ClusterOutput(aligned_bottom_curve)

# ==== cluster AnchorPointsSelector: Creates a sub-curve and finds corresponding anchor points
subcurve_selection_domain = ClusterInput()
anchor_points_frame_a = ClusterInput()
anchor_points_frame_b = ClusterInput()
anchor_points_frame_a_2 = Point(anchor_points_frame_a)
average = Average(Input=anchor_points_frame_a_2)
anchor_points_frame_b_2 = Point(anchor_points_frame_b)
base_curves = ClusterInput()

# ---- group: Taking the Desired Sub Curve
subcurve_selection_domain_2 = Number(subcurve_selection_domain)
subtraction = Subtraction(A="1", SubCurveSelectionDomain=subcurve_selection_domain_2)
dom = ConstructDomain(DomainStart=subcurve_selection_domain_2, DomainEnd=subtraction)
sub_curve = SubCurve(BaseCurves=reparameterize(base_curves), Domain=dom)
item = ListItem(List=sub_curve, Index=0, Wrap=True)  # -> Item, Item1

# ----
circle = Circle(Plane=average, Radius=1)
asymmetry_correction_shift = ClusterInput()
sub_curve_2 = SubCurve(BaseCurve=reparameterize(circle), Domain=Slider(1, range=0..1))
sort_along_curve = SortAlongCurve(Points=anchor_points_frame_b_2, Curve=sub_curve_2)  # -> Points, Indices
sort_along_curve_2 = SortAlongCurve(Points=anchor_points_frame_a_2, Curve=sub_curve_2)  # -> Points, Indices
asymmetry_correction_shift_2 = Number(asymmetry_correction_shift)

# ---- group: Filtering Points that are not on the Sub Curve
crv_cp = CurveClosestPoint(Point=sort_along_curve.Points, Curve=item.Item1)  # -> Point, Parameter, Distance
equalst = EqualityWithinTolerance(FirstNumber="0", SecondNumber=crv_cp.Distance, Tolerance="1")  # -> Equality, Inequality
shift = ShiftList(List=equalst.Equality, AsymmetryCorrectionShift=asymmetry_correction_shift_2, Wrap=True)
cull = CullPattern(List=sort_along_curve.Points, CullPattern=shift)

crv_cp_2 = CurveClosestPoint(Point=sort_along_curve_2.Points, Curve=item.Item)  # -> Point, Parameter, Distance
equalst_2 = EqualityWithinTolerance(FirstNumber="0", SecondNumber=crv_cp_2.Distance, Tolerance="1")  # -> Equality, Inequality
shift_2 = ShiftList(List=equalst_2.Equality, AsymmetryCorrectionShift=asymmetry_correction_shift_2, Wrap=True)
cull_2 = CullPattern(List=sort_along_curve_2.Points, CullPattern=shift_2)

# ----
construct_point = ConstructPoint(XCoordinate=0, YCoordinate=0, ZCoordinate=0)
number_slider = Slider(1, range=0..10)
bottom_frame_point_selection = Point(cull)
top_frame_point_selection = Point(cull_2)
point_list = PointList(Points=cull_2, Size=number_slider)
top_frame_point_selection_2 = ClusterOutput(top_frame_point_selection)
point_list_2 = PointList(Points=cull, Size=number_slider)
bottom_frame_point_selection_2 = ClusterOutput(bottom_frame_point_selection)

# ==== cluster Cluster
domain = ClusterInput()
base_curve = ClusterInput()
sub_curve = SubCurve(BaseCurve=reparameterize(base_curve), Domain=domain)
unit_z = UnitZ(Factor=Slider(10, range=0..10))
end_points = EndPoints(Curve=sub_curve)  # -> Start, End
move = Move(Geometry=end_points.End, Motion=unit_z)  # -> Geometry, Transform
line = Line(StartPoint=end_points.End, EndPoint=move.Geometry)
visual = ClusterOutput(line)
curve = ClusterOutput(sub_curve)

# ==== cluster BODY
syntax_pline = ClusterInput()
point = ClusterInput()
point_2 = ClusterInput()
syntax_pline_2 = Curve(syntax_pline)
point_3 = Point(point_2)
point_4 = Point(point)
lng = ListLength(List=point_4)
lng_2 = ListLength(List=point_4)
c_script = CSharpScript(lengthA=lng_2, lengthB=lng)  # -> out, outA, outB; inputs lengthA: Int32, lengthB: Int32
# ---------- c_script: C# ----------
    List<string> valA = new List<string>();
    List<string> valB = new List<string>();


    for (int i = 0; i < lengthA; i++){
      valA.Add("A");

    }

    for (int i = 0; i < lengthB; i++){
      valB.Add("B");

    }


    outA = valA;
    outB = valB;
# ---------- end c_script ----------
series = Series(Start=0, Step=1, Count=lng_2)
series_2 = Series(Start=0, Step=1, Count=lng)
cp = ControlPoints(Curve=syntax_pline_2)  # -> Points, Weights, Knots
points = Entwine(Branch00=point_4, Branch01=point_3, FlattenInputs=True)  # -> flatten(Result)
indices = Entwine(Branch00=series, Branch01=series_2, FlattenInputs=True)  # -> flatten(Result)
identifiers = Entwine(Branch00=c_script.outA, Branch01=c_script.outB, FlattenInputs=True)  # -> flatten(Result)
cp_2 = ClosestPoint(Point=cp.Points, Cloud=points)  # -> ClosestPoint, CPIndex, Distance
item = ListItem(List=indices, Index=cp_2.CPIndex, Wrap=True)
item_2 = ListItem(List=identifiers, Index=cp_2.CPIndex, Wrap=True)
concat = Concatenate(FragmentA=item, FragmentB=item_2)
R = ClusterOutput(concat)
