# Grasshopper definition Experiemental Fiber Winding Syntax.gh (Grasshopper 1.0.7)
# plug-ins: Kangaroo2 Components, Kangaroo Components, Weaverbird

curve = Curve(<curve referenced from the Rhino model>)
# 2D Winding Syntax
panel = Panel("")
number_slider = Slider(0.28, range=0..1)
number_slider_2 = Slider(0.5, range=0..100)
number_slider_3 = Slider(1, range=0..100)
subtraction = Subtraction(A=number_slider_3, B=number_slider)
construct_domain = ConstructDomain(DomainStart=Slider(0, range=0..100), DomainEnd=number_slider)
construct_domain_2 = ConstructDomain(DomainStart=number_slider, DomainEnd=number_slider_2)
construct_domain_3 = ConstructDomain(DomainStart=number_slider_2, DomainEnd=subtraction)
construct_domain_4 = ConstructDomain(DomainStart=subtraction, DomainEnd=number_slider_3)
curve_2 = Curve(<curve referenced from the Rhino model>)
sub_curve = SubCurve(BaseCurve=reparameterize(curve), Domain=construct_domain)
sub_curve_2 = SubCurve(BaseCurve=reparameterize(curve), Domain=construct_domain_2)
sub_curve_3 = SubCurve(BaseCurve=reparameterize(curve), Domain=construct_domain_3)
sub_curve_4 = SubCurve(BaseCurve=reparameterize(curve), Domain=construct_domain_4)
number_slider_4 = Slider(1, range=0..1)

points_on_top_frame = Point([Point(107.9469306, 0, 105.8224003), Point(107.6803451, -1.446105394, 105.8179056), Point(106.9761415, -2.740536694, 105.7952575), Point(105.9987291, -3.84518491, 105.7374702), Point(104.8624854, -4.78354202, 105.6345315), Point(103.6325333, -5.587621387, 105.4791101)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])
points_on_bottom_frame = Point([Point(123.0264757, 2.420803567, 44.1654435), Point(122.9085908, -1.079489238, 44.18770846), Point(122.0639216, -4.474939387, 44.11892086), Point(120.3598206, -7.525035271, 44.00225049), Point(117.8968807, -10.00879508, 43.89399937), Point(115.0199266, -12.00962324, 43.80461133)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])

subtraction_2 = Subtraction(A=number_slider_4, B=Slider(0.39, range=0..1))
number_slider_5 = Slider(0.28, range=0..1)
number_slider_6 = Slider(0.5, range=0..100)
number_slider_7 = Slider(1, range=0..100)
point_list = PointList(Points=points_on_bottom_frame, Size=1)
curve_outer_left = Curve(sub_curve)
curve_outer_right = Curve(sub_curve_4)
subtraction_3 = Subtraction(A=number_slider_7, B=number_slider_5)
number_of_sections_defines_the_gradient = Slider(7, range=0..40)  # "Number of Sections (defines the gradient resolution)"
number_of_sections_defines_the_gradient_2 = Slider(9, range=0..40)  # "Number of Sections (defines the gradient resolution)"
construct_domain_5 = ConstructDomain(DomainStart=Slider(0, range=0..100), DomainEnd=number_slider_5)
construct_domain_6 = ConstructDomain(DomainStart=number_slider_5, DomainEnd=number_slider_6)
construct_domain_7 = ConstructDomain(DomainStart=number_slider_6, DomainEnd=subtraction_3)
construct_domain_8 = ConstructDomain(DomainStart=subtraction_3, DomainEnd=number_slider_7)
min_value = Slider(0.1, range=0..1)
min_value_2 = Slider(0.09, range=0..1)
construct_domain_9 = ConstructDomain(DomainStart=Slider(0, range=0..1), DomainEnd=Slider(0.39, range=0..1))
construct_domain_10 = ConstructDomain(DomainStart=subtraction_2, DomainEnd=number_slider_4)
number_slider_8 = Slider(80, range=0..1000)
division = Division(A=number_slider_8, B=Slider(2, range=0..10))
sub_curve_5 = SubCurve(BaseCurve=reparameterize(curve_2), Domain=construct_domain_5)
sub_curve_6 = SubCurve(BaseCurve=reparameterize(curve_2), Domain=construct_domain_6)
sub_curve_7 = SubCurve(BaseCurve=reparameterize(curve_2), Domain=construct_domain_7)
sub_curve_8 = SubCurve(BaseCurve=reparameterize(curve_2), Domain=construct_domain_8)
sub_curve_9 = SubCurve(BaseCurve=reparameterize(curve_outer_left), Domain=construct_domain_9)
sub_curve_10 = SubCurve(BaseCurve=reparameterize(curve_outer_right), Domain=construct_domain_10)
# 3D Winding Syntax
panel_2 = Panel("")
construct_domain_11 = ConstructDomain(DomainStart=1, DomainEnd=min_value)
construct_domain_12 = ConstructDomain(DomainStart=1, DomainEnd=min_value_2)
divide_curve = DivideCurve(Curve=sub_curve_8, Count=number_slider_8, Kinks=False)  # -> Points, Tangents, Parameters
divide_curve_2 = DivideCurve(Curve=sub_curve_7, Count=number_slider_8, Kinks=False)  # -> Points, Tangents, Parameters
divide_curve_3 = DivideCurve(Curve=sub_curve_5, Count=number_slider_8, Kinks=False)  # -> Points, Tangents, Parameters
divide_curve_4 = DivideCurve(Curve=sub_curve_6, Count=number_slider_8, Kinks=False)  # -> Points, Tangents, Parameters
panel_3 = Panel("""1
0
0
0
1
0
0
0
1
0
0
1
0
0
0
0
0
1
0
0
1
0
0
0
0
0
1""")
range = Range(Domain=construct_domain_11, Steps=number_of_sections_defines_the_gradient)
range_2 = Range(Domain=construct_domain_12, Steps=number_of_sections_defines_the_gradient_2)
panel_4 = Panel("""1
0
0
0
1
0
0""")
shift_list = ShiftList(List=divide_curve_3.Points, Shift=Slider(40, range=0..100), Wrap=True)
shift_list_2 = ShiftList(List=divide_curve_4.Points, Shift=Slider(12, range=0..100), Wrap=True)
shift_list_3 = ShiftList(List=divide_curve_2.Points, Shift=Slider(44, range=0..100), Wrap=True)
weave = Weave(Pattern=panel_3, Stream0=reverse(divide_curve_3.Points), Stream1=shift_list_2, NullGaps=False)
shift_list_4 = ShiftList(List=divide_curve.Points, Shift=Slider(12, range=0..100), Wrap=True)
reverse_list = ReverseList(List=range)
reverse_list_2 = ReverseList(List=range_2)
line = Line(StartPoint=shift_list, EndPoint=divide_curve_4.Points)
weave_2 = Weave(Pattern=panel_4, Stream0=reverse(divide_curve_2.Points), Stream1=shift_list_4, NullGaps=False)
line_2 = Line(StartPoint=divide_curve_3.Points, EndPoint=shift_list_2)
line_3 = Line(StartPoint=shift_list_3, EndPoint=divide_curve.Points)
explode = Explode(Curve=line, Recursive=True)  # -> Segments, Vertices
line_4 = Line(StartPoint=divide_curve_2.Points, EndPoint=shift_list_4)
explode_2 = Explode(Curve=line_2, Recursive=True)  # -> Segments, Vertices
cull_index = CullIndex(List=reverse_list, Indices=0, Wrap=True)
cull_index_2 = CullIndex(List=reverse_list_2, Indices=0, Wrap=True)
explode_3 = Explode(Curve=line_3, Recursive=True)  # -> Segments, Vertices
explode_4 = Explode(Curve=line_4, Recursive=True)  # -> Segments, Vertices
polyline = PolyLine(Vertices=flatten(weave), Closed=False)
polyline_2 = PolyLine(Vertices=flatten(explode.Vertices), Closed=False)
polyline_3 = PolyLine(Vertices=flatten(explode_2.Vertices), Closed=False)
polyline_4 = PolyLine(Vertices=flatten(weave_2), Closed=False)
merge = Merge(Data1=range, Data2=cull_index)  # -> flatten(Result)
merge_2 = Merge(Data1=range_2, Data2=cull_index_2)  # -> flatten(Result)
polyline_5 = PolyLine(Vertices=flatten(explode_3.Vertices), Closed=False)
polyline_6 = PolyLine(Vertices=flatten(explode_4.Vertices), Closed=False)
construct_domain_13 = ConstructDomain(DomainStart=Slider(0, range=0..1), DomainEnd=Slider(0.692, range=0..1))

length_of_anchor = Slider(8, range=0..10)

construct_domain_14 = ConstructDomain(DomainStart=Slider(0.162, range=0..1), DomainEnd=Slider(0.893, range=0..1))
construct_domain_15 = ConstructDomain(DomainStart=Slider(0.28, range=0..1), DomainEnd=Slider(0.56, range=0..1))
construct_domain_16 = ConstructDomain(DomainStart=Slider(0, range=0..1), DomainEnd=Slider(0.7, range=0..1))
construct_domain_17 = ConstructDomain(DomainStart=Slider(0.162, range=0..1), DomainEnd=Slider(0.893, range=0..1))
construct_domain_18 = ConstructDomain(DomainStart=Slider(0.28, range=0..1), DomainEnd=Slider(0.56, range=0..1))
panel_5 = Panel("""1
0
0
0
1
0
0
0
1
0
0
1
0
0
0
0
0
1
0
0
1
0
0
0
0
0
1""")
number_slider_9 = Slider(25, range=0..100)
number_slider_10 = Slider(25, range=0..100)
number_slider_11 = Slider(39, range=0..100)
curve_top_frame = Curve(<curve referenced from the Rhino model>)
curve_bottom_frame = Curve(<curve referenced from the Rhino model>)
curve_top_frame_2 = Curve(<curve referenced from the Rhino model>)
curve_bottom_frame_2 = Curve(<curve referenced from the Rhino model>)
sub_curve_11 = SubCurve(BaseCurve=reparameterize(polyline_2), Domain=construct_domain_14)
curve_top_frame_3 = Curve(<curve referenced from the Rhino model>)
sub_curve_12 = SubCurve(BaseCurve=reparameterize(polyline), Domain=construct_domain_13)
sub_curve_13 = SubCurve(BaseCurve=reparameterize(polyline_3), Domain=construct_domain_15)
panel_6 = Panel("""1
0
0
0
1
0
0
0
1
0
0
1
0
0
0
0
0
1
0
0
1
0
0
0
0
0
1""")
curve_bottom_frame_3 = Curve(<curve referenced from the Rhino model>)
sub_curve_14 = SubCurve(BaseCurve=reparameterize(polyline_5), Domain=construct_domain_17)
number_slider_12 = Slider(16, range=0..100)
sub_curve_15 = SubCurve(BaseCurve=reparameterize(polyline_4), Domain=construct_domain_16)
sub_curve_16 = SubCurve(BaseCurve=reparameterize(polyline_6), Domain=construct_domain_18)

number_slider_13 = Slider(0.36, range=0..1)
number_slider_14 = Slider(0.04, range=0..1)

number_slider_15 = Slider(0.64, range=0..1)
number_slider_16 = Slider(0.16, range=0..1)

divide_curve_5 = DivideCurve(Curve=curve_top_frame, Count=number_slider_9, Kinks=False)  # -> Points, Tangents, Parameters
divide_curve_6 = DivideCurve(Curve=curve_bottom_frame, Count=number_slider_9, Kinks=False)  # -> Points, Tangents, Parameters
divide_curve_7 = DivideCurve(Curve=curve_top_frame_2, Count=number_slider_10, Kinks=False)  # -> Points, Tangents, Parameters
divide_curve_8 = DivideCurve(Curve=curve_bottom_frame_2, Count=number_slider_10, Kinks=False)  # -> Points, Tangents, Parameters
divide_curve_9 = DivideCurve(Curve=curve_top_frame_3, Count=number_slider_11, Kinks=False)  # -> Points, Tangents, Parameters
divide_curve_10 = DivideCurve(Curve=curve_bottom_frame_3, Count=number_slider_11, Kinks=False)  # -> Points, Tangents, Parameters
panel_7 = Panel("""1
0
0
0
1
0
0
1""")
division_2 = Division(A=number_slider_10, B=Slider(2, range=0..10))

anchor_length = Slider(3, range=0..10)
anchor_width = Slider(0.5, range=0..10)

number_slider_17 = Slider(0.74, range=0..1)
number_slider_18 = Slider(0.11, range=0..1)

shift_list_5 = ShiftList(List=divide_curve_6.Points, Shift=Slider(4, range=0..10), Wrap=True)
panel_8 = Panel("1")
shift_list_6 = ShiftList(List=divide_curve_5.Points, Shift=Slider(4, range=0..10), Wrap=True)
curve_3 = Curve([sub_curve_11, sub_curve_13, sub_curve_12])

# ---- group: Crossings
split_list = SplitList(List=divide_curve_7.Points, Index=division_2)  # -> ListA, ListB
split_list_2 = SplitList(List=divide_curve_8.Points, Index=division_2)  # -> ListA, ListB
weave_3 = Weave(Pattern=[0, 1], Stream0=split_list.ListA, Stream1=split_list_2.ListA, NullGaps=False)
weave_4 = Weave(Pattern=[0, 1], Stream0=split_list.ListB, Stream1=split_list_2.ListB, NullGaps=False)
polyline_7 = PolyLine(Vertices=flatten(weave_3), Closed=False)
polyline_8 = PolyLine(Vertices=flatten(weave_4), Closed=False)

# ---- group: Weaving
panel_9 = Panel("""0
1
0
0
1
1""")
weave_5 = Weave(Pattern=panel_9, Stream0=divide_curve_7.Points, Stream1=divide_curve_8.Points, NullGaps=False)
polyline_9 = PolyLine(Vertices=flatten(weave_5), Closed=False)

# ----
shift_list_7 = ShiftList(List=divide_curve_10.Points, Shift=Slider(44, range=0..100), Wrap=True)
shift_list_8 = ShiftList(List=divide_curve_9.Points, Shift=Slider(24, range=0..100), Wrap=True)
curve_4 = Curve([sub_curve_14, sub_curve_16, sub_curve_15])
line_5 = Line(StartPoint=shift_list_5, EndPoint=divide_curve_6.Points)
point_list_2 = PointList(Points=divide_curve_9.Points)
line_6 = Line(StartPoint=divide_curve_5.Points, EndPoint=shift_list_6)

# ---- group: Parameters
anchors_count = Slider(80, range=0..1000)

# ----
divide_curve_11 = DivideCurve(Curve=sub_curve_10, Count=anchors_count, Kinks=False)  # -> Points, Tangents, Parameters
divide_curve_12 = DivideCurve(Curve=sub_curve_9, Count=anchors_count, Kinks=False)  # -> Points, Tangents, Parameters
reverse_list_3 = ReverseList(List=divide_curve_11.Points)
c__x_approach = CSharpScript(AnchorsCount=number_slider_9, Anchors_A=divide_curve_5.Points, Anchors_B=divide_curve_6.Points, shift=number_slider_12)  # -> out, finalList; inputs AnchorsCount: Int32, Anchors_A: list of Point3d, Anchors_B: list of Point3d, shift: Int32
# ---------- c__x_approach: C# ----------
    List<Point3d> FinalAnchors = new List<Point3d>();


    for (int i = 0; i < AnchorsCount - shift; i++){

      Point3d a = Anchors_A[i];
      Point3d b = Anchors_B[i + shift];
      Point3d c = Anchors_B[i];
      Point3d d = Anchors_A[i + shift];
      FinalAnchors.Add(a);
      FinalAnchors.Add(b);
      FinalAnchors.Add(c);
      FinalAnchors.Add(d);

    }

    finalList = FinalAnchors;
# ---------- end c__x_approach ----------
construct_domain_19 = ConstructDomain(DomainStart=Slider(0, range=0..1), DomainEnd=Slider(0.692, range=0..1))

# ---- group: Weaving
panel_10 = Panel("""0
1
0
0
1
1
1
0""")
weave_6 = Weave(Pattern=panel_10, Stream0=shift_list_8, Stream1=shift_list_7, NullGaps=False)
polyline_10 = PolyLine(Vertices=flatten(weave_6), Closed=False)

# ----
curve_top_frame_4 = Curve(<curve referenced from the Rhino model>)
curve_bottom_frame_4 = Curve(<curve referenced from the Rhino model>)

# ---- group: Pure Shift
line_7 = Line(StartPoint=shift_list_8, EndPoint=shift_list_7)
explode_5 = Explode(Curve=line_7, Recursive=True)  # -> Segments, Vertices
polyline_11 = PolyLine(Vertices=flatten(explode_5.Vertices), Closed=False)

# ----
point_list_3 = PointList(Points=shift_list_8)

# ---- group: Continuous Shift
number_slider_19 = Slider(0.214, range=0..1)
c__shift_approach = CSharpScript(iShift=number_slider_12, iPointsA=flatten(divide_curve_5.Points), iPointsB=flatten(divide_curve_6.Points))  # -> out, oFinalPoints; inputs iShift: Int32, iPointsA: list of Point3d, iPointsB: list of Point3d
# ---------- c__shift_approach: C# ----------
    int iPointsACount = iPointsA.Count;
    int iPointsBCount = iPointsB.Count;
    int maxPoints = iPointsACount;

    // create frame objects

    Frame frameA = new Frame(iPointsA);
    Frame frameB = new Frame(iPointsB);


    // determine smaller frame

    if (iPointsACount < iPointsBCount){
      // a is smaller
      frameA.isSmaller = true;
      maxPoints = iPointsBCount;
      frameA.maxPoints = maxPoints;
      frameA.insertPoints();
      Print("Frame A is smaller");
    }

    else if (iPointsBCount < iPointsACount){
      // b is smaller
      frameB.isSmaller = true;
      maxPoints = iPointsACount;
      frameB.maxPoints = maxPoints;
      frameB.insertPoints();
      Print("Frame B is smaller");
    }

    // create selectors

    List < int > selectA = new List<int>(){0};
    List < int> selectB = new List<int>(){iShift};

    int selectorA = 0;
    int selectorB = 0;

    for (int i = 0; i < maxPoints; i++){

      selectorA = (selectorA + iShift * 2) % maxPoints;

      if(selectA.Contains(selectorA))
        selectorA += 1;

      selectA.Add(selectorA);

      selectorB = (selectorA + iShift) % maxPoints;

      if(selectB.Contains(selectorB))
        selectorB += 1;

      selectB.Add(selectorB);

    }


    // select and weave points

    List<Point3d> finalPoints = new List<Point3d>();

    for (int i = 0; i < maxPoints; i++){

      finalPoints.Add(frameA.windingPins[selectA[i]]);
      finalPoints.Add(frameB.windingPins[selectB[i]]);
    }


    oFinalPoints = finalPoints;
# ---------- c__shift_approach: C# additional code ----------
  class Frame{

    public bool isSmaller;
    public int maxPoints;
    int length;
    public List<int>duplicatePositions;
    public List<Point3d> windingPins;

    // constructor
    public Frame(List<Point3d>_windingPins){

      isSmaller = false;
      windingPins = _windingPins;
      length = windingPins.Count;

    }

    public void insertPoints(){

      // generate list of positions

      int space = 5;
      duplicatePositions = new List<int>();

      for (int i = 0; i < length; i++){

        if(i % space == 0){
          duplicatePositions.Add(i);
        }
      }

      for(int i = 0; i < duplicatePositions.Count; i++){

        int pos = duplicatePositions[i] + i;
        Point3d dupValue = windingPins[pos];
        windingPins.Insert(pos, dupValue);

      }
    }
  }
# ---------- end c__shift_approach ----------
point = Point(c__shift_approach.oFinalPoints)
polyline_12 = PolyLine(Vertices=flatten(c__shift_approach.oFinalPoints), Closed=True)
sub_curve_17 = SubCurve(BaseCurve=reparameterize(polyline_12), Domain=number_slider_19)

# ---- group: shift list
shift_list_9 = ShiftList(List=divide_curve_6.Points, Shift=Slider(15, range=0..100), Wrap=True)
line_8 = Line(StartPoint=divide_curve_5.Points, EndPoint=shift_list_9)
explode_6 = Explode(Curve=line_8, Recursive=True)  # -> Segments, Vertices
construct_domain_20 = ConstructDomain(DomainStart=number_slider_19, DomainEnd="1")
polyline_13 = PolyLine(Vertices=flatten(explode_6.Vertices), Closed=False)
end_points = EndPoints(Curve=reparameterize(reverse(polyline_13)))  # -> Start, End
sub_curve_18 = SubCurve(BaseCurve=reparameterize(polyline_13), Domain=construct_domain_20)
point_2 = Point(end_points.Start)

# ---- group: Weaving
panel_11 = Panel("""0
1
1
0""")
weave_7 = Weave(Pattern=panel_11, Stream0=divide_curve_5.Points, Stream1=shift_list_9, NullGaps=False)
polyline_14 = PolyLine(Vertices=flatten(weave_7), Closed=False)

# ----
curve_5 = Curve(polyline_9)
sub_curve_19 = SubCurve(BaseCurve=reparameterize(polyline_11), Domain=Slider(1, range=0..1))
curve_6 = Curve(polyline_7)
curve_7 = Curve(polyline_8)
construct_domain_21 = ConstructDomain(DomainStart=Slider(0, range=0..1), DomainEnd=Slider(1, range=0..1))
end_points_2 = EndPoints(Curve=polyline_14)  # -> Start, End
sub_curve_20 = SubCurve(BaseCurve=reparameterize(polyline_14), Domain=Slider(1, range=0..1))
curve_8 = Curve(sub_curve_19)
curve_9 = Curve(polyline_10)
point_3 = Point(end_points_2.Start)
curve_10 = Curve(sub_curve_20)
curve_11 = Curve(sub_curve_18)
curve_12 = Curve(sub_curve_17)
custom_preview = CustomPreview(Geometry=curve_12, Material=ColourSwatch(SwatchColor=RGB(254, 255, 255)))
curve_13 = Curve(line_5)
custom_preview_2 = CustomPreview(Geometry=curve_11, Material=ColourSwatch(SwatchColor=RGB(255, 0, 255)))
curve_14 = Curve(line_6)
custom_preview_3 = CustomPreview(Geometry=curve_10, Material=ColourSwatch(SwatchColor=RGB(0, 255, 255)))

number_of_sections_defines_the_gradient_3 = Slider(6, range=0..40)  # "Number of Sections (defines the gradient resolution)"
min_value_3 = Slider(0.15, range=0..1)
number_slider_20 = Slider(13, range=0..100)

# ----
# Prepare for 3D printing
frame_thickness = Slider(5, range=0..10)
show_opening_frame = Brep(<brep referenced from the Rhino model>)
unit_z = UnitZ(Factor=frame_thickness)
unit_z_2 = UnitZ(Factor=Slider(18, range=0..100))
move = Move(Geometry=show_opening_frame, Motion=expr("-x", unit_z_2))  # -> Geometry, Transform
extrude = Extrude(Base=move.Geometry, Direction=expr("-x", unit_z))
number_slider_21 = Slider(22, range=0..100)
area = Area(Geometry=extrude)  # -> Area, Centroid
simple_mesh = SimpleMesh(Brep=extrude)
unit_z_3 = UnitZ(Factor=Slider(3, range=0..10))
unit_x = UnitX(Factor=number_slider_21)
unit_z_4 = UnitZ(Factor=Slider(7.05, range=0..10))
unit_x_2 = UnitX(Factor=number_slider_21)
move_2 = Move(Geometry=area.Centroid, Motion=expr("-x", unit_x_2))  # -> Geometry, Transform
move_3 = Move(Geometry=area.Centroid, Motion=unit_x)  # -> Geometry, Transform
shoe_opening_frame_3d_printing = Mesh(simple_mesh)
move_4 = Move(Geometry=move_3.Geometry, Motion=expr("-x", unit_z_3))  # -> Geometry, Transform
move_5 = Move(Geometry=move_2.Geometry, Motion=unit_z_4)  # -> Geometry, Transform
number_slider_22 = Slider(5, range=0..10)
point_4 = Point(move_4.Geometry)
point_5 = Point(move_5.Geometry)
circle = Circle(Plane=point_4, Radius=number_slider_22)
circle_2 = Circle(Plane=point_5, Radius=number_slider_22)
unit_z_5 = UnitZ(Factor=Slider(45, range=0..100))
xz_plane = XZPlane(Origin=point_5)
unit_z_6 = UnitZ(Factor=Slider(37, range=0..100))
move_6 = Move(Geometry=circle_2, Motion=expr("-x", unit_z_5))  # -> Geometry, Transform
rotate = Rotate(Geometry=circle_2, Angle=expr("-x", degrees(Slider(27, range=0..100))), Plane=xz_plane)  # -> Geometry, Transform
extrude_2 = Extrude(Base=circle, Direction=expr("-x", unit_z_6))
loft = Loft(
    Curves=[rotate.Geometry, move_6.Geometry],
    Options={Adjust=False, Closed=False, LoftEnds=0, LoftSimp=0, LoftType=0, Rebuild=10, Refit=0.01})
mesh = Mesh(extrude_2)
mesh_2 = Mesh(loft)
mesh_union = MeshUnion(Meshes=[mesh, mesh_2])
mesh_supporting_frame = Mesh(mesh_union)

number_of_sections_defines_the_gradient_4 = Slider(18, range=0..40)  # "Number of Sections (defines the gradient resolution)"
min_value_4 = Slider(0.15, range=0..1)
number_slider_23 = Slider(65, range=0..100)

text_tag = TextTag()
construct_domain_22 = ConstructDomain(DomainStart=Slider(0.2907, range=0..1), DomainEnd=Slider(1, range=0..1))

number_of_sections_defines_the_gradient_5 = Slider(10, range=0..40)  # "Number of Sections (defines the gradient resolution)"
min_value_5 = Slider(0.48, range=0..1)
number_slider_24 = Slider(16, range=0..100)

# ----
# scale and move the top opening frame to
# match the transformed bottom insole
number_slider_25 = Slider(50, range=0..100)
unit_x_3 = UnitX(Factor=number_slider_25)
unit_z_7 = UnitZ(Factor=Slider(33, range=0..1000))

curve_top_opening_frame = Curve(<curve referenced from the Rhino model>)
number_slider_26 = Slider(100, range=0..100)

# ----
# Insole Brep ( not the frame)
surface = Surface(<surface referenced from the Rhino model>)
surface_2 = Surface(<surface referenced from the Rhino model>)
area_2 = Area(Geometry=surface)  # -> Area, Centroid
area_3 = Area(Geometry=surface_2)  # -> Area, Centroid
scale = Scale(Geometry=surface_2, Center=area_3.Centroid, Factor=Slider(0.9, range=0..1))  # -> Geometry, Transform
point_6 = Point(area_2.Centroid)
unit_z_8 = UnitZ(Factor=Slider(20, range=0..100))
number_slider_27 = Slider(100, range=0..1000)

area_4 = Area(Geometry=scale.Geometry)  # -> Area, Centroid

# ----
# original surface is about 76.75mm long,
# scale to match 25.5cm in length
number_slider_28 = Slider(2, range=0..10)
scale_2 = Scale(Geometry=surface, Center=area_2.Centroid, Factor=number_slider_28)  # -> Geometry, Transform
scale_3 = Scale(Geometry=scale.Geometry, Center=area_4.Centroid, Factor=number_slider_28)  # -> Geometry, Transform
insole_brep_top = Brep(scale_2.Geometry)

scale_4 = Scale(Geometry=curve_top_opening_frame, Center=Point(0, 0, 0), Factor=number_slider_28)  # -> Geometry, Transform
move_7 = Move(Geometry=scale_4.Geometry, Motion=expr("-x", unit_x_3))  # -> Geometry, Transform
move_8 = Move(Geometry=move_7.Geometry, Motion=expr("-x", unit_z_7))  # -> Geometry, Transform
updated_curve_top_opening_frame = Curve(move_8.Geometry)

move_9 = Move(Geometry=scale_3.Geometry, Motion=expr("-x", unit_z_8))  # -> Geometry, Transform
brep_wireframe = BrepWireframe(Brep=insole_brep_top, Density=-1)
divide_curve_13 = DivideCurve(Curve=brep_wireframe, Count=number_slider_27, Kinks=False)  # -> Points, Tangents, Parameters
point_list_4 = PointList(Points=divide_curve_13.Points, Size=1)

insole_brep_bottom = Brep(move_9.Geometry)

# ----
# 60 Anchors on bottom insole frame
number_of_anchors = Slider(60, range=0..100)
brep_wireframe_2 = BrepWireframe(Brep=insole_brep_top, Density=-1)
divide_curve_14 = DivideCurve(Curve=brep_wireframe_2, Count=number_of_anchors, Kinks=False)  # -> Points, Tangents, Parameters
perp_frame = PerpFrame(Curve=brep_wireframe_2, Parameter=divide_curve_14.Parameters)
deconstruct_plane = DeconstructPlane(Plane=perp_frame)  # -> Origin, XAxis, YAxis, ZAxis
line_sdl = LineSDL(Start=divide_curve_13.Points, Direction=expr("-x", deconstruct_plane.YAxis), Length=Slider(1, range=0..1))
line_sdl_2 = LineSDL(Start=divide_curve_14.Points, Direction=expr("-x", deconstruct_plane.XAxis), Length=length_of_anchor)
line_sdl_3 = LineSDL(Start=divide_curve_14.Points, Direction=deconstruct_plane.XAxis, Length=Slider(4, range=0..10))
anchor_spacing = Slider(1, range=0..10)
join_curves = JoinCurves(Curves=[line_sdl_2, line_sdl_3], Preserve=False)
multiplication = Multiplication(A=divide_curve_14.Tangents, B=anchor_spacing)
move_10 = Move(Geometry=join_curves, Motion=expr("-x", multiplication))  # -> Geometry, Transform
move_11 = Move(Geometry=join_curves, Motion=multiplication)  # -> Geometry, Transform
end_points_3 = EndPoints(Curve=move_11.Geometry)  # -> Start, End
end_points_4 = EndPoints(Curve=move_10.Geometry)  # -> Start, End
line_9 = Line(StartPoint=end_points_3.End, EndPoint=end_points_4.End)
line_10 = Line(StartPoint=end_points_3.Start, EndPoint=end_points_4.Start)
insole_brep_top_as_frame = Brep(insole_brep_top)
join_curves_2 = JoinCurves(Curves=[line_9, line_10, move_11.Geometry, move_10.Geometry], Preserve=False)
brep_wireframe_3 = BrepWireframe(Brep=insole_brep_top_as_frame, Density=-1)
project = Project(Curve=join_curves_2, Brep=insole_brep_top_as_frame, Direction=Vector(0, 0, 1))
multiplication_2 = Multiplication(A=number_of_anchors, B="2")
divide_curve_15 = DivideCurve(Curve=brep_wireframe_3, Count=multiplication_2, Kinks=False)  # -> Points, Tangents, Parameters
panel_13 = Panel(project)
curve_curve = CurveCurve(CurveA=project, CurveB=brep_wireframe_3)  # -> Points, ParamsA, ParamsB
shift_list_10 = ShiftList(List=divide_curve_15.Points, Shift=1, Wrap=True)
list_item = ListItem(List=curve_curve.Points, Index=0, Wrap=True)  # -> Item, Item1
point_list_5 = PointList(Points=shift_list_10)
cull_nth = CullNth(List=shift_list_10, CullFrequency=2)  # -> graft(List)
point_7 = Point(list_item.Item1)
point_8 = Point(list_item.Item)
panel_14 = Panel("""0
2
1""")
shift_list_11 = ShiftList(List=flatten(point_7), Shift=1, Wrap=True)  # -> graft(List)
line_11 = Line(StartPoint=point_8, EndPoint=shift_list_11)
weave_8 = Weave(Pattern=panel_14, Stream0=point_8, Stream1=shift_list_11, Stream2=cull_nth, NullGaps=False)
nurbs_curve = NurbsCurve(Vertices=weave_8, Degree=Slider(2, range=0..10), Periodic=False)  # -> Curve, Length, Domain
panel_15 = Panel(nurbs_curve.Curve)
list_item_2 = ListItem(List=flatten(nurbs_curve.Curve), Index=0, Wrap=True)

# ----
# 60 anchors on shoe opening frame
curve_5mm_offset_from_the_updated_curve = Curve(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)
length = Length(Curve=curve_5mm_offset_from_the_updated_curve)
division_3 = Division(A=length, B=number_of_anchors)
divide_curve_16 = DivideCurve(Curve=curve_5mm_offset_from_the_updated_curve, Count=number_of_anchors, Kinks=False)  # -> Points, Tangents, Parameters
multiplication_3 = Multiplication(A=number_of_anchors, B="2")
perp_frame_2 = PerpFrame(Curve=curve_5mm_offset_from_the_updated_curve, Parameter=divide_curve_16.Parameters)
divide_curve_17 = DivideCurve(Curve=curve_5mm_offset_from_the_updated_curve, Count=multiplication_3, Kinks=False)  # -> Points, Tangents, Parameters
deconstruct_plane_2 = DeconstructPlane(Plane=perp_frame_2)  # -> Origin, XAxis, YAxis, ZAxis
point_9 = Point(divide_curve_17.Points)
shift_list_12 = ShiftList(List=point_9, Shift=Slider(1, range=0..10), Wrap=True)
cull_nth_2 = CullNth(List=shift_list_12, CullFrequency=2)
multiplication_4 = Multiplication(A=divide_curve_16.Tangents, B=anchor_width)
line_sdl_4 = LineSDL(Start=divide_curve_16.Points, Direction=deconstruct_plane_2.XAxis, Length=anchor_length)
point_10 = Point(cull_nth_2)
move_12 = Move(Geometry=line_sdl_4, Motion=expr("-x", multiplication_4))  # -> Geometry, Transform
move_13 = Move(Geometry=line_sdl_4, Motion=multiplication_4)  # -> Geometry, Transform
point_list_6 = PointList(Points=point_10, Size=0.5)
end_points_5 = EndPoints(Curve=move_13.Geometry)  # -> Start, End
end_points_6 = EndPoints(Curve=move_12.Geometry)  # -> Start, End
point_11 = Point(end_points_5.End)
point_12 = Point(end_points_6.End)
shift_list_13 = ShiftList(List=end_points_6.Start, Shift=1, Wrap=True)
shift_list_14 = ShiftList(List=end_points_6.End, Shift=1, Wrap=True)
point_13 = Point(shift_list_13)
point_14 = Point(end_points_5.Start)
line_12 = Line(StartPoint=end_points_5.Start, EndPoint=shift_list_13)
line_13 = Line(StartPoint=end_points_5.End, EndPoint=end_points_6.End)
point_list_7 = PointList(Points=point_12, Size=0.5)
panel_16 = Panel("""0
1
2""")
point_list_8 = PointList(Points=point_11, Size=0.5)
weave_9 = Weave(
    Pattern=panel_16,
    Stream0=graft(end_points_5.Start),
    Stream1=graft(point_10),
    Stream2=graft(shift_list_13),
    NullGaps=False)
nurbs_curve_2 = NurbsCurve(Vertices=weave_9, Degree=Slider(2, range=0..10), Periodic=False)  # -> Curve, Length, Domain
join_curves_3 = JoinCurves(Curves=[move_13.Geometry, move_12.Geometry, line_13, nurbs_curve_2.Curve], Preserve=False)
panel_17 = Panel(join_curves_3)

# ----
# trimmed surfacce
number_slider_29 = Slider(100, range=0..100)
updated_curve_top_opening_frame_2 = Curve(updated_curve_top_opening_frame)
divide_curve_18 = DivideCurve(Curve=updated_curve_top_opening_frame_2, Count=number_slider_29, Kinks=False)  # -> Points, Tangents, Parameters
divide_curve_19 = DivideCurve(Curve=curve_5mm_offset_from_the_updated_curve, Count=number_slider_29, Kinks=False)  # -> Points, Tangents, Parameters
polyline_15 = PolyLine(Vertices=flatten(divide_curve_18.Points), Closed=False)
polyline_16 = PolyLine(Vertices=flatten(divide_curve_19.Points), Closed=False)
fragment_patch = FragmentPatch(Boundary=polyline_15)
fragment_patch_2 = FragmentPatch(Boundary=polyline_16)
area_5 = Area(Geometry=fragment_patch)  # -> Area, Centroid
scale_5 = Scale(Geometry=polyline_15, Center=area_5.Centroid, Factor=Slider(0.53, range=0..1))  # -> Geometry, Transform
project_2 = Project(Curve=scale_5.Geometry, Brep=fragment_patch_2, Direction=Vector(0, 0, 1))
fragment_patch_3 = FragmentPatch(Boundary=project_2)
unit_z_9 = UnitZ(Factor=1)
multiplication_5 = Multiplication(A=unit_z_9, B=Slider(0.5, range=0..1))
extrude_3 = Extrude(Base=fragment_patch_3, Direction=unit_z_9)
move_14 = Move(Geometry=extrude_3, Motion=expr("-x", multiplication_5))  # -> Geometry, Transform
trim_solid = TrimSolid(Shape=fragment_patch_2, Cutters=move_14.Geometry)
brep_wireframe_4 = BrepWireframe(Brep=trim_solid, Density=-1)
panel_18 = Panel(brep_wireframe_4)

list_item_3 = ListItem(List=divide_curve_13.Points, Index=0, Wrap=True)
merge_3 = Merge(Data1=divide_curve_13.Points, Data2=list_item_3)
polyline_17 = PolyLine(Vertices=flatten(merge_3), Closed=False)
panel_19 = Panel(polyline_17)
fragment_patch_4 = FragmentPatch(Boundary=polyline_17)

bake_in_rhino_and_use_it_to_trim_the_bre = Curve(join_curves_3)  # "bake in rhino and use it to trim the brep"
bake_in_rhino_and_to_be_trimmed = Brep(trim_solid)

curve_insole_frame = Curve(brep_wireframe)
divide_curve_20 = DivideCurve(Curve=updated_curve_top_opening_frame, Count=number_slider_26, Kinks=False)  # -> Points, Tangents, Parameters
divide_curve_21 = DivideCurve(Curve=curve_insole_frame, Count=number_slider_26, Kinks=False)  # -> Points, Tangents, Parameters
anchors_on_bottom_insole_frame = Point(flatten(cull_nth))
shift_list_15 = ShiftList(List=divide_curve_21.Points, Shift=Slider(36, range=0..100), Wrap=True)
shift_list_16 = ShiftList(List=anchors_on_bottom_insole_frame, Shift=Slider(35, range=0..100), Wrap=True)
point_list_9 = PointList(Points=shift_list_16, Size=1)

point_15 = Point(divide_curve_20.Points)
point_16 = Point(shift_list_15)

point_list_10 = PointList(Points=point_15, Size=0.5)

brep_wireframe_5 = BrepWireframe(Brep=insole_brep_bottom, Density=-1)
divide_curve_22 = DivideCurve(Curve=brep_wireframe_5, Count=number_slider_27, Kinks=False)  # -> Points, Tangents, Parameters
point_list_11 = PointList(Points=divide_curve_22.Points, Size=1)
shift_list_17 = ShiftList(List=divide_curve_22.Points, Shift=Slider(98, range=0..100), Wrap=True)
point_list_12 = PointList(Points=shift_list_17, Size=1)
line_14 = Line(StartPoint=divide_curve_13.Points, EndPoint=shift_list_17)
loft_2 = Loft(Curves=line_14, Options={Adjust=True, Closed=True, LoftEnds=0, LoftSimp=0, LoftType=0, Rebuild=10, Refit=0.01})

list_item_4 = ListItem(List=divide_curve_22.Points, Index=0, Wrap=True)
merge_4 = Merge(Data1=divide_curve_22.Points, Data2=list_item_4)
polyline_18 = PolyLine(Vertices=flatten(merge_4), Closed=False)
fragment_patch_5 = FragmentPatch(Boundary=polyline_18)

brep_join = BrepJoin(Breps=[loft_2, fragment_patch_4, fragment_patch_5])  # -> flatten(Breps), Closed
panel_20 = Panel(brep_join.Breps)

mesh_3 = Mesh(brep_join.Breps)
mesh_union_2 = MeshUnion(Meshes=mesh_3)
weaverbird_s_mesh_thicken = WeaverbirdsMeshThicken(MeshCurves=mesh_3, Distance=expr("-x", Slider(10, range=0..10)), OffsetType=0)

list_item_5 = ListItem(List=shift_list_16, Index=0, Wrap=True)
merge_5 = Merge(Data1=shift_list_16, Data2=list_item_5)
number_slider_30 = Slider(0.5, range=0..1)
nurbs_curve_3 = NurbsCurve(Vertices=merge_5, Degree=3, Periodic=False)  # -> Curve, Length, Domain
evaluate_curve = EvaluateCurve(Curve=reparameterize(updated_curve_top_opening_frame), Parameter=number_slider_30)  # -> Point, Tangent, Angle
evaluate_curve_2 = EvaluateCurve(Curve=reparameterize(nurbs_curve_3.Curve), Parameter=number_slider_30)  # -> Point, Tangent, Angle
divide_curve_23 = DivideCurve(Curve=nurbs_curve_3.Curve, Count=number_slider_26, Kinks=False)  # -> Points, Tangents, Parameters
closest_point = ClosestPoint(Point=evaluate_curve.Point, Cloud=point_15)  # -> ClosestPoint, CPIndex, Distance
closest_point_2 = ClosestPoint(Point=evaluate_curve_2.Point, Cloud=divide_curve_23.Points)  # -> ClosestPoint, CPIndex, Distance
point_17 = Point(divide_curve_23.Points)
point_list_13 = PointList(Points=point_17, Size=1)
split_list_3 = SplitList(List=point_15, Index=closest_point.CPIndex)  # -> ListA, ListB
split_list_4 = SplitList(List=divide_curve_23.Points, Index=closest_point_2.CPIndex)  # -> ListA, ListB

point_18 = Point(reverse(split_list_3.ListB))
point_19 = Point(split_list_3.ListA)
point_20 = Point(split_list_4.ListA)
point_21 = Point(split_list_4.ListB)

point_list_14 = PointList(Points=point_19, Size=0.5)

divide_curve_24 = DivideCurve(Curve=sub_curve, Count=anchors_count, Kinks=False)  # -> simplify(Points), Tangents, Parameters
divide_curve_25 = DivideCurve(Curve=sub_curve_2, Count=anchors_count, Kinks=False)  # -> simplify(Points), Tangents, Parameters
number_of_sections_defines_the_gradient_6 = Slider(12, range=0..40)  # "Number of Sections (defines the gradient resolution)"
shift_list_to_move_along_curve = Slider(18, range=0..40)
min_value_6 = Slider(0.21, range=0..1)

# ---- group: Creates the secList
construct_domain_23 = ConstructDomain(DomainStart=1, DomainEnd=min_value_6)
range_3 = Range(Domain=construct_domain_23, Steps=number_of_sections_defines_the_gradient_6)
reverse_list_4 = ReverseList(List=range_3)
cull_index_3 = CullIndex(List=reverse_list_4, Indices=0, Wrap=True)
merge_6 = Merge(Data1=range_3, Data2=cull_index_3)  # -> flatten(Result)
shift_list_18 = ShiftList(List=merge_6, Shift=shift_list_to_move_along_curve, Wrap=True)

# ----
panel_22 = Panel(cull_index_3)
panel_23 = Panel(merge_6)
shift_list_19 = ShiftList(List=merge, Shift=shift_list_to_move_along_curve, Wrap=True)
shift_list_20 = ShiftList(List=merge_2, Shift=shift_list_to_move_along_curve, Wrap=True)

c__gradientanchorselection = CSharpScript(initPointsA=divide_curve_24.Points, initPointsB=divide_curve_25.Points, secList=shift_list_18)  # -> out, oSelectedIndicesA, oSelectedPointsA, oSelectedIndicesB, oSelectedPointsB; inputs initPointsA: list of Point3d, initPointsB: list of Point3d, secList: list of Double
# ---------- c__gradientanchorselection: C# usings ----------
using System.IO;
using System.Text.RegularExpressions;
using System.Linq;
# ---------- c__gradientanchorselection: C# ----------
    //___________ This script selects two lists of points based on a gradient list defined by the user_________
    //___________ re_duque_11/04/22___________________________________________________________________________


    double numPoints = initPointsA.Count(); //total number of points in initPoints
    double numSection = secList.Count();
    List<int> SelectedPointsIndicesA = new List<int>();
    List<Point3d> SelectedPointsA = new List<Point3d>();
    List<int> SelectedPointsIndicesB = new List<int>();
    List<Point3d> SelectedPointsB = new List<Point3d>();
    int i = 0;

    Print("numSection=" + numSection.ToString());

    while (i < numPoints) // go through the list until reaches its end without defining the step size
    {

      Print("i=" + i.ToString());

      // add the i to the list
      SelectedPointsA.Add(initPointsA[i]); //adds current Point
      SelectedPointsIndicesA.Add(i); // adds current index
      SelectedPointsB.Add(initPointsB[i]); //adds current Point
      SelectedPointsIndicesB.Add(i);

      // which section are we in? Remap the indexes to their respective sections
      int mySection = (int) Math.Floor(i / numPoints * numSection); // i/numPoints gives the relative position of the index in the list.  (Math.Floor rounds down the number)

      Print("mySection=" + mySection.ToString());

      //what is the section density? calculate the skip factor: Density/1
      int skip = (int) Math.Round(1 / secList[mySection]); // secList[mySection] gives the skip value based on the list you defined with the densitity ratios

      // gets i value

      i = i + skip;


    }


    oSelectedPointsA = SelectedPointsA;
    oSelectedIndicesA = SelectedPointsIndicesA;

    oSelectedPointsB = SelectedPointsB;
    oSelectedIndicesB = SelectedPointsIndicesB;
# ---------- end c__gradientanchorselection ----------
final_seclist = Panel(shift_list_18)

c__gradientanchorselection_2 = CSharpScript(initPointsA=divide_curve_24.Points, initPointsB=divide_curve_25.Points, secList=shift_list_19)  # -> out, oSelectedIndicesA, oSelectedPointsA, oSelectedIndicesB, oSelectedPointsB; inputs initPointsA: list of Point3d, initPointsB: list of Point3d, secList: list of Double; same code as c__gradientanchorselection
c__gradientanchorselection_3 = CSharpScript(initPointsA=divide_curve_12.Points, initPointsB=reverse_list_3, secList=shift_list_20)  # -> out, oSelectedIndicesA, oSelectedPointsA, oSelectedIndicesB, oSelectedPointsB; inputs initPointsA: list of Point3d, initPointsB: list of Point3d, secList: list of Double; same code as c__gradientanchorselection
weave_10 = Weave(
    Pattern=panel_5,
    Stream0=reverse(c__gradientanchorselection_2.oSelectedPointsA),
    Stream1=c__gradientanchorselection_2.oSelectedPointsB,
    NullGaps=False)
weave_11 = Weave(
    Pattern=panel_7,
    Stream0=reverse(c__gradientanchorselection_3.oSelectedPointsA),
    Stream1=c__gradientanchorselection_3.oSelectedPointsB,
    NullGaps=False)
polyline_19 = PolyLine(Vertices=flatten(weave_10), Closed=False)
shift_list_21 = ShiftList(List=c__gradientanchorselection_3.oSelectedPointsA, Shift=Slider(33, range=0..100), Wrap=True)
line_15 = Line(StartPoint=shift_list_21, EndPoint=c__gradientanchorselection_3.oSelectedPointsB)
explode_7 = Explode(Curve=line_15, Recursive=True)  # -> Segments, Vertices
polyline_20 = PolyLine(Vertices=flatten(explode_7.Vertices), Closed=False)

# ---- group: Creates the secList
# - Defines a gradient for the selection of anchors from an initial list.
# - Min % value defines how sparse the center is.
# - Number of sections defines in how many percentage groups are you spliting your gradient.
# - The shift moves the gradient along the curve.
construct_domain_24 = ConstructDomain(DomainStart=1, DomainEnd=min_value_6)
range_4 = Range(Domain=construct_domain_24, Steps=number_of_sections_defines_the_gradient_6)
reverse_list_5 = ReverseList(List=range_4)
cull_index_4 = CullIndex(List=reverse_list_5, Indices=0, Wrap=True)
merge_7 = Merge(Data1=range_4, Data2=cull_index_4)  # -> flatten(Result)
shift_list_22 = ShiftList(List=merge_7, Shift=shift_list_to_move_along_curve, Wrap=True)

# ----
panel_24 = Panel(range_4)
sub_curve_21 = SubCurve(BaseCurve=reparameterize(polyline_19), Domain=construct_domain_19)
panel_25 = Panel(reverse_list_5)
sub_curve_22 = SubCurve(BaseCurve=reparameterize(polyline_20), Domain=construct_domain_21)
panel_26 = Panel(cull_index_4)

divide_curve_26 = DivideCurve(Curve=curve_top_frame_4, Count=anchors_count, Kinks=False)  # -> simplify(Points), Tangents, Parameters
divide_curve_27 = DivideCurve(Curve=curve_bottom_frame_4, Count=anchors_count, Kinks=False)  # -> simplify(Points), Tangents, Parameters
# attractor point to create gradient
c__gradientanchorselection_4 = CSharpScript(initPointsA=divide_curve_26.Points, initPointsB=divide_curve_27.Points, secList=shift_list_22)  # -> out, oSelectedIndicesA, oSelectedPointsA, oSelectedIndicesB, oSelectedPointsB; inputs initPointsA: list of Point3d, initPointsB: list of Point3d, secList: list of Double; same code as c__gradientanchorselection
final_seclist_2 = Panel(shift_list_22)

panel_27 = Panel(merge_7)
shift_list_23 = ShiftList(List=divide_curve_27.Points, Shift=Slider(1, range=0..10), Wrap=True)
shift_list_24 = ShiftList(List=divide_curve_26.Points, Shift=Slider(1, range=0..10), Wrap=True)
line_16 = Line(StartPoint=shift_list_23, EndPoint=divide_curve_27.Points)
line_17 = Line(StartPoint=shift_list_24, EndPoint=divide_curve_26.Points)
point_22 = Point(c__gradientanchorselection_4.oSelectedPointsB)
point_23 = Point(c__gradientanchorselection_4.oSelectedPointsA)

number_slider_31 = Slider(26, range=0..100)
# +Weaving
panel_28 = Panel("""0
1
1
0""")
shift_list_25 = ShiftList(List=c__gradientanchorselection_4.oSelectedPointsB, Shift=number_slider_31, Wrap=False)
shift_list_26 = ShiftList(List=c__gradientanchorselection_4.oSelectedPointsA, Shift=number_slider_31, Wrap=False)
weave_12 = Weave(Pattern=panel_28, Stream0=c__gradientanchorselection_4.oSelectedPointsA, Stream1=shift_list_25, NullGaps=False)
weave_13 = Weave(Pattern=panel_28, Stream0=shift_list_26, Stream1=c__gradientanchorselection_4.oSelectedPointsB, NullGaps=False)
polyline_21 = PolyLine(Vertices=weave_12, Closed=False)
polyline_22 = PolyLine(Vertices=weave_13, Closed=False)

# ----
# +Weaving
panel_29 = Panel("""1
0
0
1""")
shift_list_27 = ShiftList(List=divide_curve_26.Points, Shift=Slider(8, range=0..10), Wrap=False)
shift_list_28 = ShiftList(List=divide_curve_27.Points, Shift=Slider(16, range=0..100), Wrap=False)
weave_14 = Weave(Pattern=panel_29, Stream0=c__gradientanchorselection_4.oSelectedPointsA, Stream1=shift_list_28, NullGaps=False)
weave_15 = Weave(Pattern=panel_29, Stream0=shift_list_28, Stream1=c__gradientanchorselection_4.oSelectedPointsB, NullGaps=False)
polyline_23 = PolyLine(Vertices=weave_14, Closed=False)
polyline_24 = PolyLine(Vertices=weave_15, Closed=False)

sub_curve_23 = SubCurve(BaseCurve=reparameterize([polyline_23, polyline_24]), Domain=construct_domain_22)
curve_15 = Curve(line_17)
curve_16 = Curve(line_16)

curve_17 = Curve([polyline_21, polyline_22])

# ----
# get the the other side of the points
panel_30 = Panel("1")
subtraction_4 = Subtraction(A=".5", B=Slider(0.38, range=0..1))
addition = Addition(A=".5", B=subtraction_4)
subtraction_5 = Subtraction(A=panel_30, B=Slider(0.09, range=0..1))
construct_domain_25 = ConstructDomain(DomainStart=addition, DomainEnd=subtraction_5)

# ----
# Insole
points_on_bottom_frame_2 = Point(points_on_bottom_frame)
number_of_sections_defines_the_gradient_7 = Slider(6, range=0..40)  # "Number of Sections (defines the gradient resolution)"
nurbs_curve_4 = NurbsCurve(Vertices=points_on_bottom_frame_2, Degree=3, Periodic=False)  # -> Curve, Length, Domain
min_value_7 = Slider(0.15, range=0..1)
list_length = ListLength(List=points_on_bottom_frame_2)
division_4 = Division(A=list_length, B="2")
construct_domain_26 = ConstructDomain(DomainStart=1, DomainEnd=min_value_7)
split_list_5 = SplitList(List=points_on_bottom_frame_2, Index=division_4)  # -> ListA, ListB
point_24 = Point(split_list_5.ListB)
point_25 = Point(split_list_5.ListA)
range_5 = Range(Domain=construct_domain_26, Steps=number_of_sections_defines_the_gradient_7)
reverse_list_6 = ReverseList(List=range_5)
list_length_2 = ListLength(List=point_25)
cull_index_5 = CullIndex(List=reverse_list_6, Indices=0, Wrap=True)
list_length_3 = ListLength(List=point_24)
list_length_4 = ListLength(List=point_25)
list_length_5 = ListLength(List=point_25)
merge_8 = Merge(Data1=range_5, Data2=cull_index_5)  # -> flatten(Result)
random = Random(Range=list_length_2, Number=1, Seed=Slider(22, range=0..100))
random_2 = Random(Range=list_length_3, Number=1, Seed=Slider(52, range=0..100))
random_3 = Random(Range=list_length_4, Number=1, Seed=Slider(22, range=0..100))
random_4 = Random(Range=list_length_5, Number=1, Seed=Slider(2, range=0..10))
shift_list_29 = ShiftList(List=point_25, Shift=random, Wrap=True)
shift_list_30 = ShiftList(List=point_24, Shift=random_2, Wrap=True)
shift_list_31 = ShiftList(List=point_25, Shift=random_3, Wrap=True)
shift_list_32 = ShiftList(List=merge_8, Shift=Slider(13, range=0..100), Wrap=True)
c__x_approach_2 = CSharpScript(AnchorsCount=list_length_5, Anchors_A=point_25, Anchors_B=point_24, shift=random_4)  # -> out, finalList; inputs AnchorsCount: Int32, Anchors_A: list of Point3d, Anchors_B: list of Point3d, shift: Int32; same code as c__x_approach
c__gradientanchorselection_5 = CSharpScript(initPointsA=point_25, initPointsB=point_24, secList=shift_list_32)  # -> out, oSelectedIndicesA, oSelectedPointsA, oSelectedIndicesB, oSelectedPointsB; inputs initPointsA: list of Point3d, initPointsB: list of Point3d, secList: list of Double; same code as c__gradientanchorselection
line_18 = Line(StartPoint=point_24, EndPoint=shift_list_29)
line_19 = Line(StartPoint=point_24, EndPoint=shift_list_30)
line_20 = Line(StartPoint=point_25, EndPoint=shift_list_31)
point_26 = Point(c__x_approach_2.finalList)
panel_31 = Panel("""1
0
0
0
1
0
0""")
point_27 = Point(c__gradientanchorselection_5.oSelectedPointsA)
point_28 = Point(c__gradientanchorselection_5.oSelectedPointsB)
explode_8 = Explode(Curve=line_18, Recursive=True)  # -> Segments, Vertices
explode_9 = Explode(Curve=line_19, Recursive=True)  # -> Segments, Vertices
explode_10 = Explode(Curve=line_20, Recursive=True)  # -> Segments, Vertices
list_length_6 = ListLength(List=point_27)
weave_16 = Weave(Pattern=panel_31, Stream0=point_27, Stream1=point_28, NullGaps=False)  # disabled
random_5 = Random(Range=list_length_6, Number=1, Seed=Slider(38, range=0..100))
shift_list_33 = ShiftList(List=point_27, Shift=random_5, Wrap=True)
line_21 = Line(StartPoint=shift_list_33, EndPoint=point_28)
explode_11 = Explode(Curve=line_21, Recursive=True)  # -> Segments, Vertices

polyline_25 = PolyLine(Vertices=flatten(point_26), Closed=False)
polyline_26 = PolyLine(Vertices=flatten(explode_11.Vertices), Closed=False)
polyline_27 = PolyLine(Vertices=flatten(explode_8.Vertices), Closed=False)
polyline_28 = PolyLine(Vertices=flatten(explode_9.Vertices), Closed=False)
polyline_29 = PolyLine(Vertices=flatten(explode_10.Vertices), Closed=False)

geometry = Geometry([polyline_25, polyline_26, polyline_27, polyline_28, polyline_29])

# ----
# Front Part
# get the one side of the points
nurbs_curve_5 = NurbsCurve(Vertices=points_on_top_frame, Degree=3, Periodic=False)  # -> Curve, Length, Domain
nurbs_curve_6 = NurbsCurve(Vertices=points_on_bottom_frame, Degree=3, Periodic=False)  # -> Curve, Length, Domain
construct_domain_27 = ConstructDomain(DomainStart=number_slider_16, DomainEnd=number_slider_15)
sub_curve_24 = SubCurve(BaseCurve=reparameterize(nurbs_curve_5.Curve), Domain=construct_domain_27)
sub_curve_25 = SubCurve(BaseCurve=reparameterize(nurbs_curve_6.Curve), Domain=construct_domain_27)
end_points_7 = EndPoints(Curve=sub_curve_24)  # -> Start, End
end_points_8 = EndPoints(Curve=sub_curve_25)  # -> Start, End
closest_point_3 = ClosestPoint(Point=end_points_7.Start, Cloud=points_on_top_frame)  # -> ClosestPoint, CPIndex, Distance
closest_point_4 = ClosestPoint(Point=end_points_7.End, Cloud=points_on_top_frame)  # -> ClosestPoint, CPIndex, Distance
closest_point_5 = ClosestPoint(Point=end_points_8.Start, Cloud=points_on_bottom_frame)  # -> ClosestPoint, CPIndex, Distance
closest_point_6 = ClosestPoint(Point=end_points_8.End, Cloud=points_on_bottom_frame)  # -> ClosestPoint, CPIndex, Distance
split_list_6 = SplitList(List=points_on_top_frame, Index=closest_point_3.CPIndex)  # -> ListA, ListB
split_list_7 = SplitList(List=points_on_top_frame, Index=closest_point_4.CPIndex)  # -> ListA, ListB
split_list_8 = SplitList(List=points_on_bottom_frame, Index=closest_point_5.CPIndex)  # -> ListA, ListB
split_list_9 = SplitList(List=points_on_bottom_frame, Index=closest_point_6.CPIndex)  # -> ListA, ListB
point_29 = Point(split_list_7.ListA)
point_30 = Point(split_list_9.ListA)
split_list_10 = SplitList(List=point_29, Index=closest_point_3.CPIndex)  # -> ListA, ListB
split_list_11 = SplitList(List=point_30, Index=closest_point_5.CPIndex)  # -> ListA, ListB

# ----
# get the the other side of the points
panel_32 = Panel("1")
subtraction_6 = Subtraction(A=panel_32, B=number_slider_16)
subtraction_7 = Subtraction(A=panel_32, B=number_slider_15)
construct_domain_28 = ConstructDomain(DomainStart=subtraction_6, DomainEnd=subtraction_7)
sub_curve_26 = SubCurve(BaseCurve=reparameterize(nurbs_curve_6.Curve), Domain=construct_domain_28)
sub_curve_27 = SubCurve(BaseCurve=reparameterize(nurbs_curve_5.Curve), Domain=construct_domain_28)
end_points_9 = EndPoints(Curve=sub_curve_27)  # -> Start, End
end_points_10 = EndPoints(Curve=sub_curve_26)  # -> Start, End
closest_point_7 = ClosestPoint(Point=end_points_9.Start, Cloud=points_on_top_frame)  # -> ClosestPoint, CPIndex, Distance
closest_point_8 = ClosestPoint(Point=end_points_9.End, Cloud=points_on_top_frame)  # -> ClosestPoint, CPIndex, Distance
closest_point_9 = ClosestPoint(Point=end_points_10.Start, Cloud=points_on_bottom_frame)  # -> ClosestPoint, CPIndex, Distance
closest_point_10 = ClosestPoint(Point=end_points_10.End, Cloud=points_on_bottom_frame)  # -> ClosestPoint, CPIndex, Distance
split_list_12 = SplitList(List=points_on_top_frame, Index=closest_point_7.CPIndex)  # -> ListA, ListB
split_list_13 = SplitList(List=points_on_top_frame, Index=closest_point_8.CPIndex)  # -> ListA, ListB
split_list_14 = SplitList(List=points_on_bottom_frame, Index=closest_point_9.CPIndex)  # -> ListA, ListB
split_list_15 = SplitList(List=points_on_bottom_frame, Index=closest_point_10.CPIndex)  # -> ListA, ListB
point_31 = Point(split_list_13.ListA)
point_32 = Point(split_list_15.ListA)
split_list_16 = SplitList(List=point_31, Index=closest_point_7.CPIndex)  # -> ListA, ListB
split_list_17 = SplitList(List=point_32, Index=closest_point_9.CPIndex)  # -> ListA, ListB

# ----
# get the one side of the points
panel_33 = Panel("1")
subtraction_8 = Subtraction(A=panel_33, B=number_slider_13)
subtraction_9 = Subtraction(A=panel_33, B=number_slider_14)
construct_domain_29 = ConstructDomain(DomainStart=number_slider_13, DomainEnd=number_slider_14)
sub_curve_28 = SubCurve(BaseCurve=reparameterize(nurbs_curve_6.Curve), Domain=construct_domain_29)
sub_curve_29 = SubCurve(BaseCurve=reparameterize(nurbs_curve_5.Curve), Domain=construct_domain_29)
end_points_11 = EndPoints(Curve=sub_curve_29)  # -> Start, End
end_points_12 = EndPoints(Curve=sub_curve_28)  # -> Start, End
closest_point_11 = ClosestPoint(Point=end_points_11.Start, Cloud=points_on_top_frame)  # -> ClosestPoint, CPIndex, Distance
closest_point_12 = ClosestPoint(Point=end_points_11.End, Cloud=points_on_top_frame)  # -> ClosestPoint, CPIndex, Distance
closest_point_13 = ClosestPoint(Point=end_points_12.Start, Cloud=points_on_bottom_frame)  # -> ClosestPoint, CPIndex, Distance
closest_point_14 = ClosestPoint(Point=end_points_12.End, Cloud=points_on_bottom_frame)  # -> ClosestPoint, CPIndex, Distance
split_list_18 = SplitList(List=points_on_top_frame, Index=closest_point_11.CPIndex)  # -> ListA, ListB
split_list_19 = SplitList(List=points_on_top_frame, Index=closest_point_12.CPIndex)  # -> ListA, ListB
split_list_20 = SplitList(List=points_on_bottom_frame, Index=closest_point_13.CPIndex)  # -> ListA, ListB
split_list_21 = SplitList(List=points_on_bottom_frame, Index=closest_point_14.CPIndex)  # -> ListA, ListB
point_33 = Point(split_list_19.ListA)
point_34 = Point(split_list_21.ListA)
split_list_22 = SplitList(List=point_33, Index=closest_point_11.CPIndex)  # -> ListA, ListB
split_list_23 = SplitList(List=point_34, Index=closest_point_13.CPIndex)  # -> ListA, ListB

# ----
# get the the other side of the points
panel_34 = Panel("1")
subtraction_10 = Subtraction(A=panel_34, B=number_slider_17)
subtraction_11 = Subtraction(A=panel_34, B=number_slider_18)
construct_domain_30 = ConstructDomain(DomainStart=subtraction_10, DomainEnd=subtraction_11)
sub_curve_30 = SubCurve(BaseCurve=reparameterize(nurbs_curve_6.Curve), Domain=construct_domain_30)
sub_curve_31 = SubCurve(BaseCurve=reparameterize(nurbs_curve_5.Curve), Domain=construct_domain_30)
end_points_13 = EndPoints(Curve=sub_curve_31)  # -> Start, End
end_points_14 = EndPoints(Curve=sub_curve_30)  # -> Start, End
closest_point_15 = ClosestPoint(Point=end_points_13.Start, Cloud=points_on_top_frame)  # -> ClosestPoint, CPIndex, Distance
closest_point_16 = ClosestPoint(Point=end_points_13.End, Cloud=points_on_top_frame)  # -> ClosestPoint, CPIndex, Distance
closest_point_17 = ClosestPoint(Point=end_points_14.Start, Cloud=points_on_bottom_frame)  # -> ClosestPoint, CPIndex, Distance
closest_point_18 = ClosestPoint(Point=end_points_14.End, Cloud=points_on_bottom_frame)  # -> ClosestPoint, CPIndex, Distance
split_list_24 = SplitList(List=points_on_top_frame, Index=closest_point_15.CPIndex)  # -> ListA, ListB
split_list_25 = SplitList(List=points_on_top_frame, Index=closest_point_16.CPIndex)  # -> ListA, ListB
split_list_26 = SplitList(List=points_on_bottom_frame, Index=closest_point_17.CPIndex)  # -> ListA, ListB
split_list_27 = SplitList(List=points_on_bottom_frame, Index=closest_point_18.CPIndex)  # -> ListA, ListB
point_35 = Point(split_list_24.ListA)
point_36 = Point(split_list_25.ListB)
point_37 = Point(split_list_26.ListA)
point_38 = Point(split_list_27.ListB)
merge_9 = Merge(Data1=point_35, Data2=point_36)
merge_10 = Merge(Data1=point_37, Data2=point_38)

# ----
# get the one side of the points
construct_domain_31 = ConstructDomain(DomainStart=number_slider_17, DomainEnd=number_slider_18)
sub_curve_32 = SubCurve(BaseCurve=reparameterize(nurbs_curve_6.Curve), Domain=construct_domain_31)
sub_curve_33 = SubCurve(BaseCurve=reparameterize(nurbs_curve_5.Curve), Domain=construct_domain_31)
end_points_15 = EndPoints(Curve=sub_curve_33)  # -> Start, End
end_points_16 = EndPoints(Curve=sub_curve_32)  # -> Start, End
closest_point_19 = ClosestPoint(Point=end_points_15.Start, Cloud=points_on_top_frame)  # -> ClosestPoint, CPIndex, Distance
closest_point_20 = ClosestPoint(Point=end_points_15.End, Cloud=points_on_top_frame)  # -> ClosestPoint, CPIndex, Distance
closest_point_21 = ClosestPoint(Point=end_points_16.Start, Cloud=points_on_bottom_frame)  # -> ClosestPoint, CPIndex, Distance
closest_point_22 = ClosestPoint(Point=end_points_16.End, Cloud=points_on_bottom_frame)  # -> ClosestPoint, CPIndex, Distance
split_list_28 = SplitList(List=points_on_top_frame, Index=closest_point_19.CPIndex)  # -> ListA, ListB
split_list_29 = SplitList(List=points_on_top_frame, Index=closest_point_20.CPIndex)  # -> ListA, ListB
split_list_30 = SplitList(List=points_on_bottom_frame, Index=closest_point_21.CPIndex)  # -> ListA, ListB
split_list_31 = SplitList(List=points_on_bottom_frame, Index=closest_point_22.CPIndex)  # -> ListA, ListB
point_39 = Point(split_list_28.ListA)
point_40 = Point(split_list_30.ListA)
point_41 = Point(split_list_29.ListB)
point_42 = Point(split_list_31.ListB)
merge_11 = Merge(Data1=point_39, Data2=point_41)
merge_12 = Merge(Data1=point_40, Data2=point_42)

sub_curve_34 = SubCurve(BaseCurve=reparameterize(nurbs_curve_6.Curve), Domain=construct_domain_25)
sub_curve_35 = SubCurve(BaseCurve=reparameterize(nurbs_curve_5.Curve), Domain=construct_domain_25)
end_points_17 = EndPoints(Curve=sub_curve_35)  # -> Start, End
end_points_18 = EndPoints(Curve=sub_curve_34)  # -> Start, End
closest_point_23 = ClosestPoint(Point=end_points_17.Start, Cloud=points_on_top_frame)  # -> ClosestPoint, CPIndex, Distance
closest_point_24 = ClosestPoint(Point=end_points_17.End, Cloud=points_on_top_frame)  # -> ClosestPoint, CPIndex, Distance
closest_point_25 = ClosestPoint(Point=end_points_18.Start, Cloud=points_on_bottom_frame)  # -> ClosestPoint, CPIndex, Distance
closest_point_26 = ClosestPoint(Point=end_points_18.End, Cloud=points_on_bottom_frame)  # -> ClosestPoint, CPIndex, Distance
split_list_32 = SplitList(List=points_on_top_frame, Index=closest_point_23.CPIndex)  # -> ListA, ListB
split_list_33 = SplitList(List=points_on_top_frame, Index=closest_point_24.CPIndex)  # -> ListA, ListB
split_list_34 = SplitList(List=points_on_bottom_frame, Index=closest_point_25.CPIndex)  # -> ListA, ListB
split_list_35 = SplitList(List=points_on_bottom_frame, Index=closest_point_26.CPIndex)  # -> ListA, ListB
point_43 = Point(split_list_33.ListA)
point_44 = Point(split_list_35.ListA)
split_list_36 = SplitList(List=point_43, Index=closest_point_23.CPIndex)  # -> ListA, ListB
split_list_37 = SplitList(List=point_44, Index=closest_point_25.CPIndex)  # -> ListA, ListB

point_45 = Point(split_list_10.ListB)
point_46 = Point(split_list_11.ListB)

point_47 = Point(split_list_22.ListB)
point_48 = Point(split_list_23.ListB)

point_49 = Point(split_list_36.ListB)
point_50 = Point(split_list_37.ListB)

custom_preview_4 = CustomPreview(Geometry=point_45, Material=ColourSwatch(SwatchColor=RGB(254, 255, 255)))

point_51 = Point(split_list_16.ListB)
point_52 = Point(split_list_17.ListB)

point_53 = Point(merge_9)
point_54 = Point(merge_10)

point_55 = Point(merge_11)
point_56 = Point(merge_12)

point_list_15 = PointList(Points=point_46)

shift = Slider(10, range=0..20)
lng = ListLength(List=c__gradientanchorselection.oSelectedPointsA)
c__x_approach_3 = CSharpScript(
    AnchorsCount=lng,
    Anchors_A=c__gradientanchorselection.oSelectedPointsA,
    Anchors_B=c__gradientanchorselection.oSelectedPointsB,
    shift=shift)  # -> out, finalList; inputs AnchorsCount: Int32, Anchors_A: list of Point3d, Anchors_B: list of Point3d, shift: Int32; same code as c__x_approach
polyline_30 = PolyLine(Vertices=c__x_approach_3.finalList, Closed=False)

construct_domain_32 = ConstructDomain(DomainStart=Slider(0, range=0..1), DomainEnd=Slider(1, range=0..1))

sub_curve_36 = SubCurve(BaseCurve=reparameterize(polyline_30), Domain=construct_domain_32)

list_item_6 = ListItem(List=reverse(point_21), Index=-1, Wrap=True)
list_item_7 = ListItem(List=point_20, Index=0, Wrap=True)
merge_13 = Merge(Data1=point_20, Data2=list_item_6)
merge_14 = Merge(Data1=list_item_7, Data2=reverse(point_21))
point_list_16 = PointList(Points=merge_13, Size=0.5)
point_list_17 = PointList(Points=merge_14, Size=0.5)
number_slider_32 = Slider(0.51, range=0..1)
nurbs_curve_7 = NurbsCurve(Vertices=merge_13, Degree=3, Periodic=False)  # -> Curve, Length, Domain
nurbs_curve_8 = NurbsCurve(Vertices=merge_14, Degree=3, Periodic=False)  # -> Curve, Length, Domain
divide_curve_28 = DivideCurve(Curve=nurbs_curve_7.Curve, Count=Slider(50, range=0..100), Kinks=False)  # -> Points, Tangents, Parameters
evaluate_curve_3 = EvaluateCurve(Curve=reparameterize(nurbs_curve_7.Curve), Parameter=number_slider_32)  # -> Point, Tangent, Angle
divide_curve_29 = DivideCurve(Curve=nurbs_curve_8.Curve, Count=Slider(50, range=0..100), Kinks=False)  # -> Points, Tangents, Parameters
evaluate_curve_4 = EvaluateCurve(Curve=reparameterize(nurbs_curve_8.Curve), Parameter=number_slider_32)  # -> Point, Tangent, Angle
point_57 = Point(divide_curve_28.Points)
point_58 = Point(divide_curve_29.Points)
closest_point_27 = ClosestPoint(Point=evaluate_curve_3.Point, Cloud=divide_curve_28.Points)  # -> ClosestPoint, CPIndex, Distance
point_list_18 = PointList(Points=point_57, Size=1)
closest_point_28 = ClosestPoint(Point=evaluate_curve_4.Point, Cloud=divide_curve_29.Points)  # -> ClosestPoint, CPIndex, Distance
point_list_19 = PointList(Points=point_58, Size=1)
split_list_38 = SplitList(List=divide_curve_28.Points, Index=closest_point_27.CPIndex)  # -> ListA, ListB
split_list_39 = SplitList(List=divide_curve_29.Points, Index=closest_point_28.CPIndex)  # -> ListA, ListB

number_slider_33 = Slider(0.18, range=0..1)
evaluate_curve_5 = EvaluateCurve(Curve=reparameterize(nurbs_curve_8.Curve), Parameter=number_slider_33)  # -> Point, Tangent, Angle
evaluate_curve_6 = EvaluateCurve(Curve=reparameterize(nurbs_curve_7.Curve), Parameter=number_slider_33)  # -> Point, Tangent, Angle
closest_point_29 = ClosestPoint(Point=evaluate_curve_5.Point, Cloud=divide_curve_29.Points)  # -> ClosestPoint, CPIndex, Distance
closest_point_30 = ClosestPoint(Point=evaluate_curve_6.Point, Cloud=divide_curve_28.Points)  # -> ClosestPoint, CPIndex, Distance
construct_domain_33 = ConstructDomain(DomainStart=closest_point_29.CPIndex, DomainEnd=closest_point_27.CPIndex)
construct_domain_34 = ConstructDomain(DomainStart=closest_point_30.CPIndex, DomainEnd=closest_point_27.CPIndex)
split_list_40 = SplitList(List=divide_curve_29.Points, Index=closest_point_29.CPIndex)  # -> ListA, ListB
split_list_41 = SplitList(List=divide_curve_28.Points, Index=closest_point_30.CPIndex)  # -> ListA, ListB
sub_list = SubList(List=divide_curve_29.Points, Domain=construct_domain_33, Wrap=True)  # -> List, Index
sub_list_2 = SubList(List=divide_curve_28.Points, Domain=construct_domain_34, Wrap=True)  # -> List, Index

# ----
# 25
point_59 = Point(split_list_38.ListA)
point_60 = Point(split_list_39.ListA)

# ----
# 26
point_61 = Point(split_list_38.ListB)
point_62 = Point(split_list_39.ListB)

# ----
# 10
point_63 = Point(split_list_40.ListA)
point_64 = Point(split_list_41.ListA)

# ----
# 16
point_65 = Point(sub_list.List)
point_66 = Point(sub_list_2.List)

merge_15 = Merge(Data1=point_63, Data2=point_64)
removeduplicatepts = RemoveDuplicatePts(Points=merge_15, Tolerance=0.01)

custom_preview_5 = CustomPreview(Geometry=[point_59, point_60], Material=ColourSwatch(SwatchColor=RGB(254, 255, 255)))
custom_preview_6 = CustomPreview(Geometry=[point_61, point_62], Material=ColourSwatch(SwatchColor=RGB(254, 255, 0)))

shift_list_34 = ShiftList(List=removeduplicatepts, Shift=Slider(6, range=0..10), Wrap=True)
shift_list_35 = ShiftList(List=point_66, Shift=Slider(6, range=0..10), Wrap=True)

list_item_8 = ListItem(List=point_19, Index=0, Wrap=True)
list_item_9 = ListItem(List=point_18, Index=-1, Wrap=True)
merge_16 = Merge(Data1=point_19, Data2=list_item_9)
merge_17 = Merge(Data1=list_item_8, Data2=point_18)
number_slider_34 = Slider(50, range=0..100)
nurbs_curve_9 = NurbsCurve(Vertices=merge_17, Degree=3, Periodic=False)  # -> Curve, Length, Domain
nurbs_curve_10 = NurbsCurve(Vertices=merge_16, Degree=3, Periodic=False)  # -> Curve, Length, Domain
subtraction_12 = Subtraction(A=1, B=Slider(0.38, range=0..1))
divide_curve_30 = DivideCurve(Curve=nurbs_curve_9.Curve, Count=number_slider_34, Kinks=False)  # -> Points, Tangents, Parameters
divide_curve_31 = DivideCurve(Curve=nurbs_curve_10.Curve, Count=number_slider_34, Kinks=False)  # -> Points, Tangents, Parameters
evaluate_curve_7 = EvaluateCurve(Curve=reparameterize(nurbs_curve_9.Curve), Parameter=subtraction_12)  # -> Point, Tangent, Angle
evaluate_curve_8 = EvaluateCurve(Curve=reparameterize(nurbs_curve_10.Curve), Parameter=subtraction_12)  # -> Point, Tangent, Angle
point_67 = Point(divide_curve_30.Points)
point_68 = Point(divide_curve_31.Points)
point_list_20 = PointList(Points=point_68, Size=1)
closest_point_31 = ClosestPoint(Point=evaluate_curve_8.Point, Cloud=divide_curve_31.Points)  # -> ClosestPoint, CPIndex, Distance
closest_point_32 = ClosestPoint(Point=evaluate_curve_7.Point, Cloud=divide_curve_30.Points)  # -> ClosestPoint, CPIndex, Distance
point_list_21 = PointList(Points=point_67, Size=1)
list_length_7 = ListLength(List=point_62)
list_length_8 = ListLength(List=point_60)
split_list_42 = SplitList(List=divide_curve_30.Points, Index=list_length_8)  # -> ListA, ListB
split_list_43 = SplitList(List=divide_curve_31.Points, Index=list_length_7)  # -> ListA, ListB

number_slider_35 = Slider(0.18, range=0..1)
evaluate_curve_9 = EvaluateCurve(Curve=reparameterize(nurbs_curve_10.Curve), Parameter=number_slider_35)  # -> Point, Tangent, Angle
evaluate_curve_10 = EvaluateCurve(Curve=reparameterize(nurbs_curve_9.Curve), Parameter=number_slider_35)  # -> Point, Tangent, Angle
closest_point_33 = ClosestPoint(Point=evaluate_curve_9.Point, Cloud=divide_curve_31.Points)  # -> ClosestPoint, CPIndex, Distance
closest_point_34 = ClosestPoint(Point=evaluate_curve_10.Point, Cloud=divide_curve_30.Points)  # -> ClosestPoint, CPIndex, Distance
construct_domain_35 = ConstructDomain(DomainStart=closest_point_33.CPIndex, DomainEnd=list_length_7)
construct_domain_36 = ConstructDomain(DomainStart=closest_point_34.CPIndex, DomainEnd=list_length_8)
split_list_44 = SplitList(List=divide_curve_31.Points, Index=expr("x+1", closest_point_33.CPIndex))  # -> ListA, ListB
split_list_45 = SplitList(List=divide_curve_30.Points, Index=closest_point_34.CPIndex)  # -> ListA, ListB
sub_list_3 = SubList(List=divide_curve_31.Points, Domain=construct_domain_35, Wrap=True)  # -> List, Index
sub_list_4 = SubList(List=divide_curve_30.Points, Domain=construct_domain_36, Wrap=True)  # -> List, Index

point_69 = Point(split_list_43.ListA)
point_70 = Point(split_list_42.ListA)
point_71 = Point(split_list_43.ListB)
point_72 = Point(split_list_42.ListB)

# ----
# 10
point_73 = Point(split_list_44.ListA)
point_74 = Point(split_list_45.ListA)

# ----
# 16
point_75 = Point(sub_list_4.List)
point_76 = Point(sub_list_3.List)

merge_18 = Merge(Data1=point_73, Data2=point_74)

custom_preview_7 = CustomPreview(Geometry=[point_69, point_70], Material=ColourSwatch(SwatchColor=RGB(254, 255, 255)))
custom_preview_8 = CustomPreview(Geometry=[point_71, point_72], Material=ColourSwatch(SwatchColor=RGB(254, 255, 0)))

removeduplicatepts_2 = RemoveDuplicatePts(Points=merge_18, Tolerance=0.01)

# ----
# X approach for the front cover
merge_19 = Merge(Data1=point_61, Data2=reverse(point_62))
merge_20 = Merge(Data1=point_71, Data2=reverse(point_72))
removeduplicatepts_3 = RemoveDuplicatePts(Points=merge_20, Tolerance=0.01)
removeduplicatepts_4 = RemoveDuplicatePts(Points=merge_19, Tolerance=0.01)
point_list_22 = PointList(Points=removeduplicatepts_4, Size=0.5)
point_list_23 = PointList(Points=removeduplicatepts_3, Size=0.5)
flatten_tree = FlattenTree(Tree=removeduplicatepts_4, Path="{0}")  # -> reverse(Tree)
flatten_tree_2 = FlattenTree(Tree=removeduplicatepts_3, Path="{0}")
number_slider_36 = Slider(0.491, range=0..1)
c__shift_approach_2 = CSharpScript(iShift=Slider(26, range=0..100), iPointsA=flatten(flatten_tree), iPointsB=flatten(flatten_tree_2))  # -> out, oFinalPoints; inputs iShift: Int32, iPointsA: list of Point3d, iPointsB: list of Point3d; same code as c__shift_approach
polyline_31 = PolyLine(Vertices=flatten(c__shift_approach_2.oFinalPoints), Closed=True)
construct_domain_37 = ConstructDomain(DomainStart=number_slider_36, DomainEnd=Slider(0.99, range=0..1))
sub_curve_37 = SubCurve(BaseCurve=reparameterize(polyline_31), Domain=number_slider_36)
sub_curve_38 = SubCurve(BaseCurve=reparameterize(polyline_31), Domain=construct_domain_37)
custom_preview_9 = CustomPreview(Geometry=[sub_curve_37, sub_curve_38], Material=ColourSwatch(SwatchColor=RGB(255, 0, 255)))

c__shift_approach_3 = CSharpScript(iShift=Slider(9, range=0..100), iPointsA=flatten(point_66), iPointsB=flatten(point_76))  # -> out, oFinalPoints; inputs iShift: Int32, iPointsA: list of Point3d, iPointsB: list of Point3d; same code as c__shift_approach
c__shift_approach_4 = CSharpScript(iShift=Slider(17, range=0..100), iPointsA=flatten(shift_list_34), iPointsB=flatten(removeduplicatepts_2))  # -> out, oFinalPoints; inputs iShift: Int32, iPointsA: list of Point3d, iPointsB: list of Point3d; same code as c__shift_approach
line_22 = Line(StartPoint=shift_list_34, EndPoint=removeduplicatepts_2)

# ----
# Weave approach for the front cover
ghpython_script = GhPythonScript(x=flatten_tree, y=flatten_tree_2)  # -> out, a, b; inputs x: list, y: list
# ---------- ghpython_script: Python ----------
__author__ = "siennasun"

import rhinoscriptsyntax as rs

if len(x) > len(y):
    difference = len(x) - len(y)
    del x[-difference:]

elif len(x) < len(y):
    difference = len(y)-len(x)
    del y[-difference:]

    
a = x
b = y
# ---------- end ghpython_script ----------
panel_35 = Panel("""0
1
0
0
0
1
0
0""")
point_bottom = Point(ghpython_script.a)
point_top = Point(ghpython_script.b)
weave_17 = Weave(Pattern=panel_35, Stream0=reverse(point_bottom), Stream1=reverse(point_top), NullGaps=False)
weave_18 = Weave(Pattern=panel_35, Stream0=reverse(ghpython_script.b), Stream1=reverse(ghpython_script.a), NullGaps=False)
weave_19 = Weave(Pattern=panel_35, Stream0=ghpython_script.b, Stream1=ghpython_script.a, NullGaps=False)
weave_20 = Weave(Pattern=panel_35, Stream0=point_bottom, Stream1=point_top, NullGaps=False)
number_slider_37 = Slider(0.372, range=0..1)
panel_36 = Panel(weave_20)
number_slider_38 = Slider(0.673, range=0..1)
polyline_32 = PolyLine(Vertices=flatten(weave_17), Closed=True)
polyline_33 = PolyLine(Vertices=flatten(weave_19), Closed=True)
polyline_34 = PolyLine(Vertices=flatten(weave_20), Closed=True)
polyline_35 = PolyLine(Vertices=flatten(weave_18), Closed=True)
sub_curve_39 = SubCurve(BaseCurve=reparameterize(polyline_34), Domain=number_slider_38)
sub_curve_40 = SubCurve(BaseCurve=reparameterize(polyline_33), Domain=number_slider_37)
sub_curve_41 = SubCurve(BaseCurve=reparameterize(polyline_32), Domain=number_slider_38)
sub_curve_42 = SubCurve(BaseCurve=reparameterize(polyline_35), Domain=number_slider_37)
custom_preview_10 = CustomPreview(Geometry=[sub_curve_39, sub_curve_41], Material=ColourSwatch(SwatchColor=RGB(254, 255, 0)))
custom_preview_11 = CustomPreview(Geometry=[sub_curve_40, sub_curve_42], Material=ColourSwatch(SwatchColor=RGB(0, 255, 255)))

polyline_36 = PolyLine(Vertices=flatten(c__shift_approach_3.oFinalPoints), Closed=True)
explode_12 = Explode(Curve=line_22, Recursive=True)  # -> Segments, Vertices
polyline_37 = PolyLine(Vertices=flatten(c__shift_approach_4.oFinalPoints), Closed=True)
line_23 = Line(StartPoint=shift_list_35, EndPoint=point_76)
sub_curve_43 = SubCurve(BaseCurve=reparameterize(polyline_36), Domain=Slider(0.491, range=0..1))
explode_13 = Explode(Curve=line_23, Recursive=True)  # -> Segments, Vertices
polyline_38 = PolyLine(Vertices=flatten(explode_13.Vertices), Closed=True)

# ----
# Back Part
list_length_9 = ListLength(List=point_39)

# ----
# Shift list + weave
list_length_10 = ListLength(List=point_40)
list_length_11 = ListLength(List=point_36)
shift_list_36 = ShiftList(List=point_55, Shift=list_length_9, Wrap=True)
list_length_12 = ListLength(List=point_38)
number_slider_39 = Slider(9, range=0..10)
shift_list_37 = ShiftList(List=point_53, Shift=expr("-x", list_length_11), Wrap=True)
shift_list_38 = ShiftList(List=point_56, Shift=list_length_10, Wrap=True)
shift_list_39 = ShiftList(List=point_54, Shift=expr("-x", list_length_12), Wrap=True)
reverse_list_7 = ReverseList(List=shift_list_36)
list_length_13 = ListLength(List=shift_list_37)
reverse_list_8 = ReverseList(List=shift_list_38)
list_length_14 = ListLength(List=reverse_list_7)
point_list_24 = PointList(Points=shift_list_39)
random_6 = Random(Range=list_length_13, Number=1, Seed=number_slider_39)
random_7 = Random(Range=list_length_14, Number=1, Seed=number_slider_39)
point_list_25 = PointList(Points=reverse_list_7)
shift_list_40 = ShiftList(List=reverse_list_7, Shift=random_7, Wrap=True)
shift_list_41 = ShiftList(List=shift_list_37, Shift=random_6, Wrap=True)
panel_37 = Panel("""0
1
1
0
0
0
0
1
1
1""")
weave_21 = Weave(Pattern=panel_37, Stream0=shift_list_41, Stream1=shift_list_39, NullGaps=False)
weave_22 = Weave(Pattern=panel_37, Stream0=shift_list_40, Stream1=reverse_list_8, NullGaps=False)

polyline_39 = PolyLine(Vertices=flatten(weave_22), Closed=False)
polyline_40 = PolyLine(Vertices=flatten(weave_21), Closed=False)
construct_domain_38 = ConstructDomain(DomainStart=0, DomainEnd=Slider(0.56, range=0..1))
sub_curve_44 = SubCurve(BaseCurve=reparameterize([polyline_40, polyline_39]), Domain=construct_domain_38)

custom_preview_12 = CustomPreview(Geometry=sub_curve_44, Material=ColourSwatch(SwatchColor=RGB(254, 255, 255)))

# ----
# Reinforcement: Gradient + shift list
panel_38 = Panel("""0
1
1
0
0
0
0
1
1
1""")
weave_23 = Weave(Pattern=panel_38, Stream0=point_51, Stream1=point_52, NullGaps=False)
polyline_41 = PolyLine(Vertices=flatten(weave_23), Closed=False)
construct_domain_39 = ConstructDomain(DomainStart=1, DomainEnd=min_value_4)
construct_domain_40 = ConstructDomain(DomainStart=1, DomainEnd=min_value_4)
range_6 = Range(Domain=construct_domain_39, Steps=number_of_sections_defines_the_gradient_4)
range_7 = Range(Domain=construct_domain_40, Steps=number_of_sections_defines_the_gradient_4)
reverse_list_9 = ReverseList(List=range_6)
reverse_list_10 = ReverseList(List=range_7)
cull_index_6 = CullIndex(List=reverse_list_9, Indices=0, Wrap=True)
cull_index_7 = CullIndex(List=reverse_list_10, Indices=0, Wrap=True)
merge_21 = Merge(Data1=range_6, Data2=cull_index_6)  # -> flatten(Result)
merge_22 = Merge(Data1=range_7, Data2=cull_index_7)  # -> flatten(Result)
shift_list_42 = ShiftList(List=merge_21, Shift=number_slider_23, Wrap=True)
shift_list_43 = ShiftList(List=merge_22, Shift=number_slider_23, Wrap=True)
reverse_list_11 = ReverseList(List=point_51)
reverse_list_12 = ReverseList(List=point_52)
c__gradientanchorselection_6 = CSharpScript(initPointsA=point_45, initPointsB=point_46, secList=shift_list_42)  # -> out, oSelectedIndicesA, oSelectedPointsA, oSelectedIndicesB, oSelectedPointsB; inputs initPointsA: list of Point3d, initPointsB: list of Point3d, secList: list of Double; same code as c__gradientanchorselection
panel_39 = Panel("""1
0
0
0
1
0
0
1""")
c__gradientanchorselection_7 = CSharpScript(initPointsA=reverse_list_11, initPointsB=reverse_list_12, secList=shift_list_43)  # -> out, oSelectedIndicesA, oSelectedPointsA, oSelectedIndicesB, oSelectedPointsB; inputs initPointsA: list of Point3d, initPointsB: list of Point3d, secList: list of Double; same code as c__gradientanchorselection
number_slider_40 = Slider(15, range=0..100)
point_77 = Point(c__gradientanchorselection_6.oSelectedPointsA)
point_78 = Point(c__gradientanchorselection_6.oSelectedPointsB)
weave_24 = Weave(
    Pattern=panel_39,
    Stream0=reverse(c__gradientanchorselection_6.oSelectedPointsA),
    Stream1=c__gradientanchorselection_6.oSelectedPointsB,
    NullGaps=False)
weave_25 = Weave(
    Pattern=panel_39,
    Stream0=reverse(c__gradientanchorselection_7.oSelectedPointsA),
    Stream1=c__gradientanchorselection_7.oSelectedPointsB,
    NullGaps=False)
point_79 = Point(c__gradientanchorselection_7.oSelectedPointsB)
point_80 = Point(c__gradientanchorselection_7.oSelectedPointsA)
shift_list_44 = ShiftList(List=c__gradientanchorselection_6.oSelectedPointsA, Shift=number_slider_40, Wrap=True)
polyline_42 = PolyLine(Vertices=flatten(weave_24), Closed=False)
shift_list_45 = ShiftList(List=c__gradientanchorselection_7.oSelectedPointsA, Shift=number_slider_40, Wrap=True)
polyline_43 = PolyLine(Vertices=flatten(weave_25), Closed=False)
line_24 = Line(StartPoint=shift_list_44, EndPoint=c__gradientanchorselection_6.oSelectedPointsB)
line_25 = Line(StartPoint=shift_list_45, EndPoint=c__gradientanchorselection_7.oSelectedPointsB)
explode_14 = Explode(Curve=line_24, Recursive=True)  # -> Segments, Vertices
explode_15 = Explode(Curve=line_25, Recursive=True)  # -> Segments, Vertices

polyline_44 = PolyLine(Vertices=flatten(explode_14.Vertices), Closed=False)
polyline_45 = PolyLine(Vertices=flatten(explode_15.Vertices), Closed=False)

geometry_2 = Geometry([polyline_45, polyline_44])

custom_preview_13 = CustomPreview(Geometry=geometry_2, Material=ColourSwatch(SwatchColor=RGB(19, 0, 255)))

# ----
# Shift Approach
number_slider_41 = Slider(36, range=0..100)
list_length_15 = ListLength(List=point_45)
list_length_16 = ListLength(List=point_51)
random_8 = Random(Range=list_length_15, Number=1, Seed=number_slider_41)
random_9 = Random(Range=list_length_16, Number=1, Seed=number_slider_41)
shift_list_46 = ShiftList(List=point_45, Shift=random_8, Wrap=True)
shift_list_47 = ShiftList(List=point_51, Shift=random_9, Wrap=True)
line_26 = Line(StartPoint=shift_list_46, EndPoint=point_46)
line_27 = Line(StartPoint=shift_list_47, EndPoint=point_52)
explode_16 = Explode(Curve=line_26, Recursive=True)  # -> Segments, Vertices
explode_17 = Explode(Curve=line_27, Recursive=True)  # -> Segments, Vertices

point_81 = Point(shift_list_46)
point_list_26 = PointList(Points=shift_list_46)

polyline_46 = PolyLine(Vertices=flatten(explode_16.Vertices), Closed=False)
polyline_47 = PolyLine(Vertices=flatten(explode_17.Vertices), Closed=False)

geometry_3 = Geometry([polyline_47, polyline_46])

custom_preview_14 = CustomPreview(Geometry=geometry_3, Material=ColourSwatch(SwatchColor=RGB(254, 255, 255)))

shift_2 = Slider(2, range=0..20)
lng_2 = ListLength(List=c__gradientanchorselection_4.oSelectedPointsA)
# + X Approach
c__x_approach_4 = CSharpScript(
    AnchorsCount=lng_2,
    Anchors_A=c__gradientanchorselection_4.oSelectedPointsA,
    Anchors_B=c__gradientanchorselection_4.oSelectedPointsB,
    shift=shift_2)  # -> out, finalList; inputs AnchorsCount: Int32, Anchors_A: list of Point3d, Anchors_B: list of Point3d, shift: Int32; same code as c__x_approach
polyline_48 = PolyLine(Vertices=c__x_approach_4.finalList, Closed=False)

construct_domain_41 = ConstructDomain(DomainStart=Slider(0.1459, range=0..1), DomainEnd=Slider(0.1974, range=0..1))

sub_curve_45 = SubCurve(BaseCurve=reparameterize(polyline_48), Domain=construct_domain_41)

panel_40 = Panel(sub_curve_45)

curve_18 = Curve(sub_curve_23)
curve_19 = Curve(sub_curve_45)

# ----
# Reinforcement Layer: gradient + shift
construct_domain_42 = ConstructDomain(DomainStart=1, DomainEnd=min_value_3)
construct_domain_43 = ConstructDomain(DomainStart=1, DomainEnd=min_value_3)
range_8 = Range(Domain=construct_domain_42, Steps=number_of_sections_defines_the_gradient_3)
range_9 = Range(Domain=construct_domain_43, Steps=number_of_sections_defines_the_gradient_3)
reverse_list_13 = ReverseList(List=range_8)
reverse_list_14 = ReverseList(List=range_9)
cull_index_8 = CullIndex(List=reverse_list_13, Indices=0, Wrap=True)
cull_index_9 = CullIndex(List=reverse_list_14, Indices=0, Wrap=True)
merge_23 = Merge(Data1=range_8, Data2=cull_index_8)  # -> flatten(Result)
merge_24 = Merge(Data1=range_9, Data2=cull_index_9)  # -> flatten(Result)
shift_list_48 = ShiftList(List=merge_23, Shift=number_slider_20, Wrap=True)
shift_list_49 = ShiftList(List=merge_24, Shift=number_slider_20, Wrap=True)
c__gradientanchorselection_8 = CSharpScript(initPointsA=point_47, initPointsB=point_48, secList=shift_list_48)  # -> out, oSelectedIndicesA, oSelectedPointsA, oSelectedIndicesB, oSelectedPointsB; inputs initPointsA: list of Point3d, initPointsB: list of Point3d, secList: list of Double; same code as c__gradientanchorselection
c__gradientanchorselection_9 = CSharpScript(initPointsA=point_49, initPointsB=point_50, secList=shift_list_49)  # -> out, oSelectedIndicesA, oSelectedPointsA, oSelectedIndicesB, oSelectedPointsB; inputs initPointsA: list of Point3d, initPointsB: list of Point3d, secList: list of Double; same code as c__gradientanchorselection
point_82 = Point(c__gradientanchorselection_8.oSelectedPointsA)
point_83 = Point(c__gradientanchorselection_8.oSelectedPointsB)
point_84 = Point(c__gradientanchorselection_9.oSelectedPointsB)
point_85 = Point(c__gradientanchorselection_9.oSelectedPointsA)
point_list_27 = PointList(Points=point_82)
point_list_28 = PointList(Points=point_85)
reverse_list_15 = ReverseList(List=point_82)
reverse_list_16 = ReverseList(List=point_83)
panel_41 = Panel("""0
1
0
0
1
0
1
0
0""")  # disabled
weave_26 = Weave(Pattern=panel_41, Stream0=reverse(reverse_list_15), Stream1=reverse_list_16, NullGaps=False)  # disabled
list_length_17 = ListLength(List=reverse_list_15)
weave_27 = Weave(
    Pattern=panel_41,
    Stream0=reverse(c__gradientanchorselection_9.oSelectedPointsA),
    Stream1=c__gradientanchorselection_9.oSelectedPointsB,
    NullGaps=False)  # disabled
random_10 = Random(Range=list_length_17, Number=1, Seed=Slider(9, range=0..100))
shift_list_50 = ShiftList(List=c__gradientanchorselection_9.oSelectedPointsA, Shift=random_10, Wrap=True)
line_28 = Line(StartPoint=shift_list_50, EndPoint=c__gradientanchorselection_9.oSelectedPointsB)
explode_18 = Explode(Curve=line_28, Recursive=True)  # -> Segments, Vertices
polyline_49 = PolyLine(Vertices=flatten(weave_26), Closed=False)  # disabled
polyline_50 = PolyLine(Vertices=flatten(weave_27), Closed=False)  # disabled
shift_list_51 = ShiftList(List=c__gradientanchorselection_8.oSelectedPointsA, Shift=random_10, Wrap=True)
line_29 = Line(StartPoint=shift_list_51, EndPoint=c__gradientanchorselection_8.oSelectedPointsB)
explode_19 = Explode(Curve=line_29, Recursive=True)  # -> Segments, Vertices

polyline_51 = PolyLine(Vertices=flatten(explode_19.Vertices), Closed=False)
polyline_52 = PolyLine(Vertices=flatten(explode_18.Vertices), Closed=False)

geometry_4 = Geometry([polyline_51, polyline_52])

# ----
# bake in Rhino and trim with the
# original frame brep, and refer
# the new brep (with the anchors) here
insole_frame_thickness = Slider(0.6, range=0..1)
merge_25 = Merge(Data1=project, Data2=nurbs_curve.Curve)
join_curves_4 = JoinCurves(Curves=flatten(merge_25), Preserve=False)
unit_z_10 = UnitZ(Factor=insole_frame_thickness)
brep = Brep(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)
extrude_4 = Extrude(Base=brep, Direction=unit_z_10)
unit_z_11 = UnitZ(Factor=Slider(5, range=0..10))

explode_20 = Explode(Curve=join_curves_4, Recursive=True)  # -> Segments, Vertices
polyline_53 = PolyLine(Vertices=flatten(explode_20.Vertices), Closed=False)
patch = Patch(Curves=polyline_53, Spans=20, Flexibility=1, Trim=True)
fragment_patch_6 = FragmentPatch(Boundary=polyline_53)
extrude_5 = Extrude(Base=polyline_53, Direction=unit_z_11)

panel_42 = Panel(fragment_patch_6)
move_15 = Move(Geometry=fragment_patch_6, Motion=unit_z_11)  # -> Geometry, Transform

to_bake = Geometry([move_15.Geometry, fragment_patch_6])
brep_2 = Brep([to_bake, extrude_5])

brep_join_2 = BrepJoin(Breps=brep_2)  # -> Breps, Closed
simple_mesh_2 = SimpleMesh(Brep=brep_join_2.Breps)
insole_frame_mesh_3d_print = Mesh(simple_mesh_2)
panel_43 = Panel(insole_frame_mesh_3d_print)

# ----
# gradient + X approach
number_slider_42 = Slider(3, range=0..10)
list_length_18 = ListLength(List=point_85)
list_length_19 = ListLength(List=point_82)
c__x_approach_5 = CSharpScript(AnchorsCount=list_length_18, Anchors_A=point_85, Anchors_B=point_84, shift=number_slider_42)  # -> out, finalList; inputs AnchorsCount: Int32, Anchors_A: list of Point3d, Anchors_B: list of Point3d, shift: Int32; same code as c__x_approach
c__x_approach_6 = CSharpScript(AnchorsCount=list_length_19, Anchors_A=point_82, Anchors_B=point_83, shift=number_slider_42)  # -> out, finalList; inputs AnchorsCount: Int32, Anchors_A: list of Point3d, Anchors_B: list of Point3d, shift: Int32; same code as c__x_approach

polyline_54 = PolyLine(Vertices=flatten(c__x_approach_6.finalList), Closed=False)
polyline_55 = PolyLine(Vertices=flatten(c__x_approach_5.finalList), Closed=False)

geometry_5 = Geometry([polyline_54, polyline_55])

# ----
# Middle Part
colour_swatch = ColourSwatch(SwatchColor=RGB(19, 255, 0))
custom_preview_15 = CustomPreview(Geometry=[geometry_4, geometry_5], Material=colour_swatch)

# ----
# Winding Frame(Mesh for 3D Printing)
solid_union = SolidUnion(Breps=[extrude, extrude_2, loft, brep_join_2.Breps])

# ---- group: whole winding frame (3d print)
mesh_4 = Mesh(solid_union)

# ----
panel_44 = Panel(mesh_4)

# ----
# Reinforcement Layer: gradient + shift
construct_domain_44 = ConstructDomain(DomainStart=1, DomainEnd=min_value_5)
construct_domain_45 = ConstructDomain(DomainStart=1, DomainEnd=min_value_5)
range_10 = Range(Domain=construct_domain_44, Steps=number_of_sections_defines_the_gradient_5)
range_11 = Range(Domain=construct_domain_45, Steps=number_of_sections_defines_the_gradient_5)
reverse_list_17 = ReverseList(List=range_10)
reverse_list_18 = ReverseList(List=range_11)
cull_index_10 = CullIndex(List=reverse_list_17, Indices=0, Wrap=True)
cull_index_11 = CullIndex(List=reverse_list_18, Indices=0, Wrap=True)
merge_26 = Merge(Data1=range_10, Data2=cull_index_10)  # -> flatten(Result)
merge_27 = Merge(Data1=range_11, Data2=cull_index_11)  # -> flatten(Result)
shift_list_52 = ShiftList(List=merge_26, Shift=number_slider_24, Wrap=True)
shift_list_53 = ShiftList(List=merge_27, Shift=number_slider_24, Wrap=True)
c__gradientanchorselection_10 = CSharpScript(initPointsA=reverse_list_7, initPointsB=reverse_list_8, secList=shift_list_52)  # -> out, oSelectedIndicesA, oSelectedPointsA, oSelectedIndicesB, oSelectedPointsB; inputs initPointsA: list of Point3d, initPointsB: list of Point3d, secList: list of Double; same code as c__gradientanchorselection
c__gradientanchorselection_11 = CSharpScript(initPointsA=shift_list_37, initPointsB=shift_list_39, secList=shift_list_53)  # -> out, oSelectedIndicesA, oSelectedPointsA, oSelectedIndicesB, oSelectedPointsB; inputs initPointsA: list of Point3d, initPointsB: list of Point3d, secList: list of Double; same code as c__gradientanchorselection
point_86 = Point(c__gradientanchorselection_10.oSelectedPointsA)
point_87 = Point(c__gradientanchorselection_10.oSelectedPointsB)
point_88 = Point(c__gradientanchorselection_11.oSelectedPointsB)
point_89 = Point(c__gradientanchorselection_11.oSelectedPointsA)
point_list_29 = PointList(Points=point_86)
point_list_30 = PointList(Points=point_89)
reverse_list_19 = ReverseList(List=point_86)
reverse_list_20 = ReverseList(List=point_87)
panel_45 = Panel("""0
1
0
0
1
0
1
0
0""")  # disabled
weave_28 = Weave(Pattern=panel_45, Stream0=reverse(reverse_list_19), Stream1=reverse_list_20, NullGaps=False)  # disabled
list_length_20 = ListLength(List=reverse_list_19)
weave_29 = Weave(
    Pattern=panel_45,
    Stream0=reverse(c__gradientanchorselection_11.oSelectedPointsA),
    Stream1=c__gradientanchorselection_11.oSelectedPointsB,
    NullGaps=False)  # disabled
random_11 = Random(Range=list_length_20, Number=1, Seed=Slider(11, range=0..100))
shift_list_54 = ShiftList(List=c__gradientanchorselection_11.oSelectedPointsA, Shift=random_11, Wrap=True)
line_30 = Line(StartPoint=shift_list_54, EndPoint=c__gradientanchorselection_11.oSelectedPointsB)
explode_21 = Explode(Curve=line_30, Recursive=True)  # -> Segments, Vertices
polyline_56 = PolyLine(Vertices=flatten(weave_28), Closed=False)  # disabled
polyline_57 = PolyLine(Vertices=flatten(weave_29), Closed=False)  # disabled
shift_list_55 = ShiftList(List=c__gradientanchorselection_10.oSelectedPointsA, Shift=random_11, Wrap=True)
line_31 = Line(StartPoint=shift_list_55, EndPoint=c__gradientanchorselection_10.oSelectedPointsB)
explode_22 = Explode(Curve=line_31, Recursive=True)  # -> Segments, Vertices

polyline_58 = PolyLine(Vertices=flatten(explode_22.Vertices), Closed=False)
polyline_59 = PolyLine(Vertices=flatten(explode_21.Vertices), Closed=False)

geometry_6 = Geometry([polyline_58, polyline_59])

custom_preview_16 = CustomPreview(Geometry=geometry_6, Material=ColourSwatch(SwatchColor=RGB(19, 0, 255)))
